# Grasshopper definition 190117 Animate-X.gh (Grasshopper 0.9.76)
# Copyright: Siemen Cuypers

number_slider = Slider(1, range=0..1)
remap = RemapNumbers(Value=number_slider, Source=Domain(0, 1), Target=Slider(180, range=0..1000))  # -> Mapped, Clipped
remap_2 = RemapNumbers(Value=number_slider, Source=Domain(0, 1), Target=Slider(100, range=0..1000))  # -> Mapped, Clipped
brep = Brep(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)

X = UnitX(Factor=remap_2.Mapped)
move = Move(Motion=X)  # -> Geometry, Transform
volume = Volume(Geometry=brep)  # -> Volume, Centroid
rotate = Rotate(Angle=degrees(remap.Mapped), Plane=volume.Centroid)  # -> Geometry, Transform
merge = Merge(Data1=rotate.Transform, Data2=move.Transform)
comp = Compound(Transforms=merge)
transform = Transform(Geometry=brep, Transform=comp)
