# Grasshopper definition ABG_1_Elements_To_Rhino.gh (Grasshopper 1.0.7)
# plug-ins: Rhino.Inside for Autodesk Revit

built_in_categories = BuiltInCategories("autodesk.revit.category.local:walls-1.0.0")
levels_picker = LevelsPicker([<levels picker referenced from the Revit model> x2])
element_type_picker = ElementTypePicker(
    built_in_categories,
    {"Basic Wall : CL_W1": "e340d1fc-19c1-4200-9ff0-415bc126641d:e9d71ae9-50a0-4fd0-b533-dbc08decd09f-00092a3a", "Basic Wall : Cavity wall_sliders": "e340d1fc-19c1-4200-9ff0-415bc126641d:f565bef9-7d27-4781-b8d4-60f4a6034d87-000ce6a8", "Basic Wall : Exterior - Block on Mtl. Stud": "e340d1fc-19c1-4200-9ff0-415bc126641d:4d24d0d6-38f1-47b8-a376-b40c6432dad5-0000d50a", "Basic Wall : Exterior - Brick on Mtl. Stud": "e340d1fc-19c1-4200-9ff0-415bc126641d:e3e052f9-0156-11d5-9301-0000863f27ad-0000018d", "Basic Wall : Foundation - 300mm Concrete": "e340d1fc-19c1-4200-9ff0-415bc126641d:7f28cee1-b998-4a37-89e2-f58405cbbc56-0008df7c", "Basic Wall : Interior - 165 Partition (1-hr)": "e340d1fc-19c1-4200-9ff0-415bc126641d:88b03b05-80d3-484f-8022-471f61604c8d-00038d32", "Basic Wall : Interior - Partition": "e340d1fc-19c1-4200-9ff0-415bc126641d:88b03b05-80d3-484f-8022-471f61604c8d-00038d7b", "Basic Wall : Retaining - 300mm Concrete": "e340d1fc-19c1-4200-9ff0-415bc126641d:1551350c-45e5-41b8-bdf1-bcfa6794dc6a-000adce2", "Basic Wall : SIP 202mm Wall - conc clad": "e340d1fc-19c1-4200-9ff0-415bc126641d:c85e5be0-d8d5-4148-836f-b55e711ef373-00068b9b", "Basic Wall : Wall - Timber Clad": "e340d1fc-19c1-4200-9ff0-415bc126641d:ef57b02a-5e81-49e7-93bb-ae5f002d921c-000306df", "Curtain Wall : SH_Curtain wall": "e340d1fc-19c1-4200-9ff0-415bc126641d:6cbabf1d-e8d0-47f0-ac4d-9a7923128d37-000700af"}, selected="Basic Wall : CL_W1")
category_filter = CategoryFilter(Categories=built_in_categories, Inverted=False)
level_filter = LevelFilter(Levels=levels_picker, Inverted=False)
logical_and_filter = LogicalAndFilter(FilterA=category_filter, FilterB=level_filter)
query_types = QueryTypes(Kind=3, Category=built_in_categories)
query_elements = QueryElements(Filter=logical_and_filter, Limit=100)  # -> Elements, Count
element_geometry = ElementGeometry(Elements=query_elements.Elements)
