# Grasshopper definition ABG_Revit_Data_to_Rhino.gh (Grasshopper 1.0.7)
# plug-ins: eleFront, Rhino.Inside for Autodesk Revit, LadybugGrasshopper, LunchBox

_2_send_geometry = LBFalseStartToggle(False)
_3_create_layers = Button()
_0_collect_meshes = Mesh([<mesh referenced from the Rhino model> x950])

get_rhino_attributes = GetRhinoAttributes(Geometry=_0_collect_meshes, fullpath=False)  # -> Name, Layer, Color, SourceFile
text_length = TextLength(Text=get_rhino_attributes.Name)
subtraction = Subtraction(A=text_length, B="8")
text_fragment = TextFragment(Text=get_rhino_attributes.Name, Start=subtraction)
ghpython_script = GhPythonScript(x=text_fragment)  # -> out, a
# ---------- ghpython_script: Python ----------
__author__ = "peter"
__version__ = "2022.12.29"

import rhinoscriptsyntax as rs

def char_trunc(x):
    if len(x) >= 8:
        x = x[1:]
    x = x[:-1]
    return x
    
a = char_trunc(x)
# ---------- end ghpython_script ----------
define_object_attributes = DefineObjectAttributes(Name=ghpython_script.a)
modify_rhino_object_attributes = ModifyRhinoObjectAttributes(ReferencedObject=_0_collect_meshes, Attributes=define_object_attributes)

stream_filter = StreamFilter(Gate=_2_send_geometry, Stream1=_0_collect_meshes)
get_rhino_attributes_2 = GetRhinoAttributes(Geometry=stream_filter, fullpath=False)  # -> Name, Layer, Color, SourceFile
active_graphical_view = ActiveGraphicalView()
selectable_in_view_filter = SelectableInViewFilter(View=active_graphical_view, Inverted=False)
query_elements = QueryElements(Filter=selectable_in_view_filter)  # -> Elements, Count
element_parameter = ElementParameter(Element=query_elements.Elements, Parameter="Id")  # -> Element, Value
element_category = ElementCategory(Element=query_elements.Elements)  # -> Element, Category
find_similar_member = FindSimilarMember(Data=get_rhino_attributes_2.Name, Set=element_parameter.Value)  # -> Hit, Index
list_item = ListItem(List=element_category.Category, Index=find_similar_member.Index, Wrap=True)

list_item_2 = ListItem(List=query_elements.Elements, Index=find_similar_member.Index, Wrap=True)
element_type = ElementType(Element=list_item_2)  # -> Element, Type
type_identity = TypeIdentity(Type=element_type.Type)  # -> Category, FamilyName, Name
text = Text(type_identity.Name)
text_2 = Text(type_identity.Category)
text_3 = Text(type_identity.FamilyName)
merge = Merge(Data1=graft(text_2), Data2=graft(text_3), Data3=graft(text), Data4=graft(find_similar_member.Hit))

category_identity = CategoryIdentity(Category=list_item)  # -> Type, Parent, Name, IsSubcategory, AllowsSubcategories, AllowsParameters, HasMaterialQuantities
create_set = CreateSet(List=category_identity.Name)  # -> Set, Map
list_length = ListLength(List=create_set.Set)  # -> expr("x-1", Length)
range = Range(Domain=Domain(0, 1), Steps=list_length)
gradient = Gradient(
    LowerLimit=0,
    UpperLimit=1,
    Parameter=range,
    stops=[0: RGB(243, 57, 0), 0.1: RGB(236, 27, 60), 0.2: RGB(210, 0, 118), 0.3: RGB(103, 0, 120), 0.4: RGB(39, 72, 161), 0.5: RGB(1, 192, 229), 0.6: RGB(18, 178, 90), 0.7: RGB(79, 186, 8), 0.8: RGB(220, 237, 32), 0.9: RGB(247, 159, 20)])
create_layers = CreateLayers(CreateToggle=_3_create_layers, LayerNames=create_set.Set, LayerColors=gradient)

panel = Panel("""Catergory
Family
Type
Id""")

define_object_attributes_2 = DefineObjectAttributes(Layer=category_identity.Name)
modify_rhino_object_attributes_2 = ModifyRhinoObjectAttributes(ReferencedObject=_0_collect_meshes, Attributes=define_object_attributes_2)

define_object_attributes_3 = DefineObjectAttributes(UserKeys=panel, UserValues=merge)  # -> flatten(Attributes)
modify_rhino_object_attributes_3 = ModifyRhinoObjectAttributes(ReferencedObject=_0_collect_meshes, Attributes=define_object_attributes_3)

define_layer = DefineLayer(Name=create_set.Set, Color=gradient)
bake_layers = BakeLayers(Layers=define_layer)
