# Grasshopper definition ABG_Rooms_To_Rhino.gh (Grasshopper 1.0.7)
# plug-ins: Rhino.Inside for Autodesk Revit, eleFront

query_categories = QueryCategories(Type=1, Name="Rooms", IsSubcategory=False)
category_filter = CategoryFilter(Categories=query_categories, Inverted=False)
query_elements = QueryElements(Filter=category_filter, Limit=100)  # -> Elements, Count
element_geometry = ElementGeometry(Elements=query_elements.Elements)  # -> flatten(Geometry)
bounding_box = BoundingBox(Content=element_geometry, Plane=PlaneXY(0, 0, 0))  # -> Box, Box_2
volume = Volume(Geometry=element_geometry)  # -> Volume, Centroid
deconstruct_box = DeconstructBox(Box=bounding_box.Box_2)  # -> Plane, X, Y, Z
brep_plane = BrepPlane(Brep=element_geometry, Plane=volume.Centroid)  # -> Curves, Points
deconstruct_domain = DeconstructDomain(Domain=deconstruct_box.Z)  # -> Start, End
area = Area(Geometry=brep_plane.Curves)  # -> Area, Centroid
subtraction = Subtraction(A=deconstruct_domain.Start, B=deconstruct_domain.End)
sort_list = SortList(Keys=area.Area, ValuesValuesA=brep_plane.Curves)  # -> Keys, ValuesValuesA
division = Division(A=subtraction, B="2")
list_item = ListItem(List=sort_list.ValuesValuesA, Index="-1", Wrap=True)  # -> flatten(Item)
unit_z = UnitZ(Factor=division)
element_parameter = ElementParameter(Element=graft(query_elements.Elements), Parameter="Number")  # -> Element, Value
element_parameter_2 = ElementParameter(Element=graft(query_elements.Elements), Parameter="Name")  # -> Element, Value
element_parameter_3 = ElementParameter(Element=graft(query_elements.Elements), Parameter="Area")  # -> Element, Value
element_parameter_4 = ElementParameter(Element=graft(query_elements.Elements), Parameter="Id")  # -> Element, Value
define_layer = DefineLayer(Name="Rooms", Color=ColourSwatch(SwatchColor=RGB(255, 255, 255)))
merge = Merge(Data1="Name", Data2="Number", Data3="Area", Data4="Id")
merge_2 = Merge(
    Data1=graft(element_parameter_2.Value),
    Data2=graft(element_parameter.Value),
    Data3=graft(element_parameter_3.Value),
    Data4=graft(element_parameter_4.Value))
move = Move(Geometry=list_item, Motion=unit_z)  # -> Geometry, Transform
define_object_attributes = DefineObjectAttributes(UserKeys=merge, UserValues=merge_2, Name=graft(element_parameter_4.Value), Layer=define_layer)  # -> flatten(Attributes)
bake = Button()
brep = Brep(move.Geometry)
bake_objects = BakeObjects(Geometry=brep, Attributes=define_object_attributes, BakeName="Rooms", Bake=bake)  # -> Message, Guids
