# Grasshopper definition Circle_Pack.gh (Grasshopper 1.0.7)
# plug-ins: Kangaroo2 Components

curve = Curve(<curve referenced from the Rhino model>)
triremesh = TriRemesh(Geometry=curve, Length=Slider(0.738, range=0..1), Iterations=25)  # -> Triangulation, Dual, Creases
mesh_edges = MeshEdges(Mesh=triremesh.Triangulation)  # -> NakedEdges, InteriorEdges, NonManifoldEdges
deconstruct_mesh = DeconstructMesh(Mesh=triremesh.Triangulation)  # -> Vertices, Faces, Colours, Normals
image_sampler = ImageSampler(
    deconstruct_mesh.Vertices,
    FilePath="C:\Users\peter\Downloads\HD-wallpaper-lights-blur-lights-dots.jpg",
    Filter="Colour",
    Interpolate=False,
    Umax=12,
    Umin=0,
    Vmax=12,
    Vmin=0,
    Wrap=1)
mesh_colours = MeshColours(Mesh=triremesh.Triangulation, Colours=image_sampler)
point_in_curve = PointInCurve(Point=deconstruct_mesh.Vertices, Curve=curve)  # -> Relationship, Point
larger_than = LargerThan(FirstNumber=point_in_curve.Relationship, SecondNumber=2)  # -> LargerThan, OrEqualTo
cull_pattern = CullPattern(List=deconstruct_mesh.Vertices, CullPattern=larger_than.OrEqualTo)
imagecircles = ImageCircles(
    Points=cull_pattern,
    Mesh=mesh_colours,
    Min=Slider(0.222, range=0..1),
    Max=Slider(0.809, range=0..1),
    Curves=curve,
    Strength=1)
solver = Solver(GoalObjects=imagecircles, Reset=Button(), Threshold=1e-15, Tolerance=0.0001, On=Toggle(True))  # -> I, V, O
circle_cnr = CircleCNR(Center=solver.V, Normal=Vector(0, 0, 1), Radius=solver.O)
