# Grasshopper definition Detail_Lines_From_Geom.gh (Grasshopper 1.0.7)
# plug-ins: Rhino.Inside for Autodesk Revit

geometry = Geometry(<brep referenced from the Rhino model>)
deconstruct_brep = DeconstructBrep(Brep=geometry)  # -> Faces, Edges, Vertices
select_element = SelectElement()  # -> Element, Selected
view = View(<floorplan referenced from the Revit model>)
add_detail_line = AddDetailLine(View=view, Curve=deconstruct_brep.Edges, TrackingMode=2)
