# Grasshopper definition EvenAreaVoronoiCellsWithinPolyline.gh (Grasshopper 0.9.56)

# ---- group: Genome and Voronoi Parcels
boundarycurve = Curve(reparameterize(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))
genes = GenePool(Minimum=0, Maximum=1, Decimals=2, Value=[0.02, 0.54, 0.38, 0.13, 0.7])
eval = EvaluateCurve(Curve=boundarycurve, Parameter=genes)  # -> Point, Tangent, Angle
voronoi = Voronoi(Points=eval.Point, BruteForceOverride=False)
rint = RegionIntersection(CurvesA=voronoi, CurvesB=boundarycurve)

# ---- group: Fitness Criteria
area = Area(Geometry=rint)  # -> Area, Centroid
area_2 = Area(Geometry=boundarycurve)  # -> Area, Centroid
lng = ListLength(List=area.Area)
num = Number(expr("round(Num,2)", area.Area))
division = Division(A=area_2.Area, B=lng)
tag = TextTag(Location=area.Centroid, Text=num)
repeat = RepeatData(Data=division, Length=lng)
subtraction = Subtraction(A=area.Area, B=repeat)
abs = Absolute(Value=subtraction)
ma = MassAddition(Input=abs)  # -> Result, PartialResults

# ---- group: GA Solver (Minimize)
galapagos = Galapagos(fitness=ma, gene=genes)
