# Grasshopper definition GetCADData.gh (Grasshopper 1.0.7)
# plug-ins: Rhino.Inside for Autodesk Revit, LunchBox

# ---- group: Collect all CAD instances in active view
active_graphical_view = ActiveGraphicalView()
owner_view_filter = OwnerViewFilter(View=active_graphical_view, Inverted=False)
class_filter = ClassFilter(Classes="Autodesk.Revit.DB.ImportInstance")
logical_and_filter = LogicalAndFilter(FilterA=class_filter, FilterB=owner_view_filter)
query_elements = QueryElements(Filter=logical_and_filter, Limit=100)  # -> Elements, Count

# ---- group: Use selected CAD instance
graphical_element = GraphicalElement(<importinstance referenced from the Revit model>)

# ----
ghpython_script = GhPythonScript(I=graphical_element)  # -> StyleNames, StyleIds, Lines
# ---------- ghpython_script: Python ----------
import clr
clr.AddReference('System.Core')
clr.AddReference('RhinoInside.Revit')
clr.AddReference('RevitAPI') 
clr.AddReference('RevitAPIUI')

from System import Enum

import rhinoscriptsyntax as rs
import Rhino
import RhinoInside
import Grasshopper
from Grasshopper.Kernel import GH_RuntimeMessageLevel as RML
from RhinoInside.Revit import Revit, Convert
# add extensions methods as well
# this allows calling .ToXXX() convertor methods on Revit objects
clr.ImportExtensions(Convert.Geometry)
from Autodesk.Revit import DB

# active Revit verison
REVIT_VERSION = Revit.ActiveUIApplication.Application.VersionNumber

# access the active document object
doc = Revit.ActiveDBDocument

def show_warning(msg):
    ghenv.Component.AddRuntimeMessage(RML.Warning, msg)

def show_error(msg):
    ghenv.Component.AddRuntimeMessage(RML.Error, msg)

def show_remark(msg):
    ghenv.Component.AddRuntimeMessage(RML.Remark, msg)


stylenames = []
styles = []
lines = []
for g in I.Geometry[DB.Options()]:
    for l in g.GetInstanceGeometry():
        stylenames.append(doc.GetElement(l.GraphicsStyleId).GraphicsStyleCategory.Name)
        styles.append(l.GraphicsStyleId.IntegerValue)
        lines.append(l.ToPolylineCurve())
StyleNames = stylenames
StyleIds = styles
Lines = lines
# ---------- end ghpython_script ----------

# ---- group: DWG path can be used to open the file in rhino ang grab data
ghpython_script_2 = GhPythonScript(CADInstance=graphical_element)  # -> LinkPath
# ---------- ghpython_script_2: Python ----------
import os.path as op
import clr
clr.AddReference('System.Core')
clr.AddReference('RhinoInside.Revit')
clr.AddReference('RevitAPI') 
clr.AddReference('RevitAPIUI')

from System import Enum

import rhinoscriptsyntax as rs
import Rhino
import RhinoInside
import Grasshopper
from Grasshopper.Kernel import GH_RuntimeMessageLevel as RML
from RhinoInside.Revit import Revit, Convert
# add extensions methods as well
# this allows calling .ToXXX() convertor methods on Revit objects
clr.ImportExtensions(Convert.Geometry)
from Autodesk.Revit import DB

# active Revit verison
REVIT_VERSION = Revit.ActiveUIApplication.Application.VersionNumber

# access the active document object
doc = Revit.ActiveDBDocument

def show_warning(msg):
    ghenv.Component.AddRuntimeMessage(RML.Warning, msg)

def show_error(msg):
    ghenv.Component.AddRuntimeMessage(RML.Error, msg)

def show_remark(msg):
    ghenv.Component.AddRuntimeMessage(RML.Remark, msg)


def get_links(linktype=None, doc=None):
    location = doc.PathName
    if not location:
        raise Exception('PathName is empty. Model is not saved.')

    linkdata = dict()
    model_path = \
        DB.ModelPathUtils.ConvertUserVisiblePathToModelPath(location)
    if not model_path:
        raise Exception('Model is not saved. Can not read links.')
    try:
        trans_data = DB.TransmissionData.ReadTransmissionData(model_path)
        external_refs = trans_data.GetAllExternalFileReferenceIds()
        for ref_id in external_refs:
            ext_ref = trans_data.GetLastSavedReferenceData(ref_id)
            link = doc.GetElement(ref_id)
            p = ext_ref.GetAbsolutePath()
            path = DB.ModelPathUtils.ConvertModelPathToUserVisiblePath(p)
            if linktype:
                if ext_ref.ExternalFileReferenceType == linktype:
                    linkdata[op.basename(path)] = path
            else:
                linkdata[op.basename(path)] = path
        return linkdata
    except Exception as data_err:
        raise Exception('Error reading links from model path: {} | {}'.format(model_path, data_err))

if isinstance(CADInstance, DB.ImportInstance):
    typename = DB.Element.Name.GetValue(doc.GetElement(CADInstance.GetTypeId()))
    links = get_links(linktype=DB.ExternalFileReferenceType.CADLink, doc=doc)
    for lname, lpath in links.items():
        if lname == typename:
            LinkPath = lpath
            break
# ---------- end ghpython_script_2 ----------
panel = Panel(ghpython_script_2)

# ----
create_set = CreateSet(List=ghpython_script.StyleNames)  # -> simplify(graft(Set)), Map
create_set_2 = CreateSet(List=ghpython_script.StyleIds)  # -> graft(Set), Map
equality = Equality(FirstNumber=create_set_2.Set, SecondNumber=ghpython_script.StyleIds)  # -> Equality, Inequality
cull_pattern = CullPattern(List=ghpython_script.Lines, CullPattern=equality.Equality)  # -> simplify(List)
layer_names = Panel(create_set.Set)
layer_content = Panel(cull_pattern)
bake = Button()
curve = Curve(cull_pattern)
object_bake = ObjectBake(
    BakeToggle=bake,
    GeometryObjects=curve,
    Layer=layer_names,
    ObjectName="GH_Obj",
    ObjectColor=RGB(255, 255, 255),
    LayerColor=RGB(255, 255, 255))
