# Grasshopper definition Layer_To_Filled_Region_RIR.gh (Grasshopper 1.0.7)
# plug-ins: EleFront, Rhino.Inside for Autodesk Revit

panel = Panel("Existing_Veg")
reference_by_layer = ReferenceByLayer(LayerName="Proposed_Veg")
split_list = SplitList(List=reference_by_layer, Index=Slider(1, range=0..1))  # -> ListA, ListB
number_slider = Slider(1, range=0..100)
deconstruct_brep = DeconstructBrep(Brep=split_list.ListA)  # -> flatten(Faces), Edges, Vertices
deconstruct_brep_2 = DeconstructBrep(Brep=split_list.ListB)  # -> flatten(Faces), Edges, Vertices
list_item = ListItem(List=deconstruct_brep.Faces, Index=number_slider, Wrap=True)
list_item_2 = ListItem(List=deconstruct_brep_2.Faces, Index=number_slider, Wrap=True)
active_graphical_view = ActiveGraphicalView()
add_region = AddRegion(View=active_graphical_view, Boundary=list_item_2, TrackingMode=2)
add_region_2 = AddRegion(View=active_graphical_view, Boundary=list_item, TrackingMode=2)
