# Grasshopper definition RVT_Select_By_Category.gh (Grasshopper 1.0.7)
# plug-ins: Rhino.Inside for Autodesk Revit

category_types = CategoryTypes({"Model": 1, "Annotation": 2, "Internal": 4, "Analytical": 5}, selected="Model")
levels = LevelsPicker(<levels picker referenced from the Revit model>)
categories = QueryCategories(Type=category_types, IsSubcategory=False)
panel = Panel(categories)
category = Category(<category referenced from the Revit model>)
levelfltr = LevelFilter(Levels=levels, Inverted=False)
catfltr = CategoryFilter(Categories=category, Inverted=False)
andfltr = LogicalAndFilter(FilterA=catfltr, FilterB=levelfltr)
elements = QueryElements(Filter=andfltr, Limit=100)  # -> Elements, Count
panel_2 = Panel(elements.Elements)
geometry = ElementGeometry(Elements=elements.Elements)
