# Grasshopper definition Revit_All_to_Rhino_veg_in_progress.gh (Grasshopper 1.0.7)
# plug-ins: Rhino.Inside for Autodesk Revit, LunchBox, Human, EleFront

active_graphical_view = ActiveGraphicalView()
built_in_categories = BuiltInCategories("autodesk.revit.category.family:detailComponents-1.0.0", LayoutLevel=2)
selectable_in_view_filter = SelectableInViewFilter(View=active_graphical_view, Inverted=False)
category_filter = CategoryFilter(Categories=built_in_categories, Inverted=False)
colour_swatch = ColourSwatch(SwatchColor=RGB(0, 255, 242))
query_elements = QueryElements(Filter=selectable_in_view_filter)  # -> Elements, Count
logical_and_filter = LogicalAndFilter(FilterA=category_filter, FilterB=selectable_in_view_filter)
create_layers = CreateLayers(CreateToggle=Button(), LayerNames="Revit_Geom", LayerColors=colour_swatch)
create_modify_layers = CreateModifyLayers(LayerName="Revit_Geom", LayerColor=colour_swatch, DeleteLayer=False, enableFullPath=False)  # -> LayerNames, LayerFullPath
query_elements_2 = QueryElements(Filter=logical_and_filter)  # -> Elements, Count
element_geometry = ElementGeometry(Elements=query_elements.Elements)  # -> flatten(Geometry)
define_layer = DefineLayer(Name=create_modify_layers.LayerNames)
define_object_attributes = DefineObjectAttributes(Layer=create_modify_layers.LayerNames, Color=colour_swatch)
element_view_geometry = ElementViewGeometry(Elements=query_elements_2.Elements, View=active_graphical_view)  # -> flatten(Geometry), Categories
panel = Panel(element_geometry)
panel_2 = Panel(element_view_geometry.Geometry)
bake_geometry = BakeGeometry(Bake=Button(), Geometry=element_geometry, Attributes=define_object_attributes, DeleteOldBakes=False, PreserveTrees=False)
