# Grasshopper definition Revit_Filled_To_Rhino.gh (Grasshopper 1.0.7)
# plug-ins: Rhino.Inside for Autodesk Revit

active_graphical_view = ActiveGraphicalView()
selectable_in_view_filter = SelectableInViewFilter(View=active_graphical_view, Inverted=False)
category = Category(<category referenced from the Revit model>)
category_filter = CategoryFilter(Categories=category, Inverted=False)
query_elements = QueryElements(Filter=category_filter)  # -> Elements, Count
element_geometry = ElementGeometry()
curve = Curve()
