# Grasshopper definition Subtract_Filled_Regiona_RIR.gh (Grasshopper 1.0.7)
# plug-ins: EleFront

reference_by_layer = ReferenceByLayer(LayerName="property_lines")
reference_by_layer_2 = ReferenceByLayer(LayerName="Existing_Veg")
reference_by_layer_3 = ReferenceByLayer(LayerName="Proposed_Veg")
join_curves = JoinCurves(Curves=reference_by_layer, Preserve=False)
merge = Merge(Data1=reference_by_layer_2, Data2=reference_by_layer_3)
brep = Brep(join_curves)
brep_join = BrepJoin(Breps=merge)  # -> Breps, Closed
solid_difference = SolidDifference(BrepsA=brep, BrepsB=brep_join.Breps)
