# Grasshopper definition all_anaylsis.gh (Grasshopper 1.0.7)
# plug-ins: LunchBox, LadybugGrasshopper, Rhino.Inside for Autodesk Revit

lb_falsestarttoggle = LBFalseStartToggle(True)
layer_information = LayerInformation(ReferenceToggle=lb_falsestarttoggle)  # -> Names, DisplayColors, GUID
value_picker = ValuePicker(layer_information.Names)
value_picker_2 = ValuePicker(layer_information.Names)
query_categories = QueryCategories(Type=1, Name="Rooms", IsSubcategory=False)
lb_falsestarttoggle_2 = LBFalseStartToggle(True)
lb_falsestarttoggle_3 = LBFalseStartToggle(True)
category_filter = CategoryFilter(Categories=query_categories, Inverted=False)
layer_reference = LayerReference(ReferenceToggle=lb_falsestarttoggle_2, LayerName=value_picker_2)  # -> flatten(Geometry), Name, UserStrings, GUID
query_elements = QueryElements(Filter=category_filter)  # -> Elements, Count
layer_reference_2 = LayerReference(ReferenceToggle=lb_falsestarttoggle_3, LayerName=value_picker)  # -> flatten(Geometry), Name, UserStrings, GUID
number_slider = Slider(22, range=1..31)
number_slider_2 = Slider(6, range=1..12)
versioner = LBVersioner()  # -> out; plug-in component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
file_path = FilePath("C:\Users\peter\Downloads\USA_NY_Westhampton-Suffolk.County.AP.744865_TMY3.epw")
element_parameter = ElementParameter(Element=query_elements.Elements, Parameter="Id")  # -> Element, Value
importepw = LBImportEPW(epw_file=file_path)  # -> location, dry_bulb_temperature, dew_point_temperature, relative_humidity, wind_speed, wind_direction, direct_normal_rad, diffuse_horizontal_rad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; plug-in component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
text = Text(layer_reference_2.Name)
project_location = ProjectLocation()  # -> SiteLocation, SharedSite, SurveyPoint, ProjectBasePoint
create_set = CreateSet(List=text)  # -> Set, Map
text_2 = Text(element_parameter.Value)
element_parameter_2 = ElementParameter(Element=project_location.ProjectBasePoint, Parameter="Angle to True North")  # -> Element, Value
find_similar_member = FindSimilarMember(Data=text_2, Set=create_set.Set)  # -> Hit, Index
legendpar = LBLegendParameters(max="400")  # -> leg_par; plug-in component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
list_item = ListItem(List=layer_reference_2.Geometry, Index=find_similar_member.Index, Wrap=True)
lb_falsestarttoggle_4 = LBFalseStartToggle(False)
analysisperiod = LBAnalysisPeriod(
    start_month=number_slider_2,
    start_day=number_slider,
    start_hour=Slider(9, range=1..23),
    end_month=number_slider_2,
    end_day=number_slider,
    end_hour=Slider(4, range=1..23),
    timestep="1")  # -> period, hoys, dates; plug-in component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
sunpath = LBSunPath(north=element_parameter_2.Value, location=importepw.location, hoys=analysisperiod.hoys, scale=1)  # -> out, vectors, altitudes, azimuths, hoys, sun_pts, analemma, daily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; plug-in component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
point = Point(Point(7.234580784, 7.070619604, 0))
directsunhours = LBDirectSunHours(
    vectors=flatten(sunpath.vectors),
    timestep="1",
    geometry=flatten(list_item),
    context=flatten(layer_reference.Geometry),
    grid_size="1",
    offset_dist="3",
    legend_par=legendpar,
    run=lb_falsestarttoggle_4)  # -> out, points, results, mesh, legend, title, int_mtx; plug-in component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
windrose = LBWindRose(
    north=element_parameter_2.Value,
    data=importepw.wind_speed,
    wind_direction=importepw.wind_direction,
    center_pt=point,
    period=analysisperiod.period)  # -> out, mesh, compass, orient_line, freq_line, windrose_line, legend, title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; plug-in component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
windprofile = LBWindProfile(north=element_parameter_2.Value, met_wind_vel=importepw.wind_speed, met_wind_dir=importepw.wind_direction, terrain="2")  # -> out, wind_speeds, wind_vectors, anchor_pts, mesh_arrows, profile_curve, speed_axis, height_axis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; plug-in component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
skymatrix = LBCumulativeSkyMatrix(
    north=element_parameter_2.Value,
    location=importepw.location,
    direct_rad=importepw.direct_normal_rad,
    diffuse_rad=importepw.diffuse_horizontal_rad,
    hoys=analysisperiod.hoys)  # -> out, sky_mtx; plug-in component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
psychrometricchart = LBPsychrometricChart(
    temperature=importepw.dry_bulb_temperature,
    rel_humidity=importepw.relative_humidity,
    pressure=importepw.barometric_pressure,
    period=analysisperiod.period)  # -> out, title, temp_lines, rh_lines, hr_lines, enth_wb_lines, mesh, legend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; plug-in component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
skydome = LBSkyDome()  # -> out, mesh, compass, legend, title, patch_vecs, patch_values, mesh_values; plug-in component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
