# Grasshopper definition basic-area-tag.gh (Grasshopper 1.0.7)

geometry = Geometry(<surface referenced from the Rhino model>)
area = Area(Geometry=geometry)  # -> Area, Centroid
format = Format(Format="{0:0.00}", Culture=127, Data0=area.Area)
text_tag_3d = TextTag3D(Location=area.Centroid, Text=format, Size=Slider(5, range=0..100), Justification=7)
