# Grasshopper definition project-geom-to-mesh.gh (Grasshopper 1.0.7)

# ----
# Set Geom
geometry = Geometry([<extrusion referenced from the Rhino model> x128])

# ----
# Set projection target
geometry_2 = Geometry(<mesh referenced from the Rhino model>)

number_slider = Slider(10, range=0..10)
area = Area(Geometry=geometry)  # -> Area, Centroid
unit_z = UnitZ(Factor=expr("x*-1", 1))
unit_z_2 = UnitZ(Factor=expr("x*-1", number_slider))
project_point = ProjectPoint(Point=area.Centroid, Direction=unit_z, Geometry=geometry_2)  # -> Point, Index
move = Move(Geometry=project_point.Point, Motion=unit_z_2)  # -> Geometry, Transform
addition = Addition(A=number_slider, B=Slider(720, range=0..1000))
cylinder = Cylinder(Base=move.Geometry, Radius=Slider(10, range=0..10), Length=addition)
