# Grasshopper definition 230923_evo_octo_test.gh (Grasshopper 1.0.7)
# plug-ins: Octopus

# ----
# Set boundary rep. for irregular shape(non-rect, non-circle)
geometry = Geometry([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])
join_curves = JoinCurves(Curves=geometry, Preserve=False)
brep = Brep(join_curves)

# ----
# Project brep to plane to ensure 2d points
xy_plane = XYPlane(Origin=Point(0, 0, 0))
project = Project(Geometry=brep, Plane=xy_plane)  # -> Geometry, Transform

# ----
# Create seed points for circle
number_slider = Slider(100, range=0..100)
populate_geometry = PopulateGeometry(Geometry=project.Geometry, Count=number_slider, Seed=1)

# ----
# Create circle at pt. in 2d population
# Point index
number_slider_2 = Slider(76, range=0..100)
list_item = ListItem(List=populate_geometry, Index=number_slider_2, Wrap=True)
circle = Circle(Plane=list_item, Radius=Slider(43, range=0..100))

number_slider_3 = Slider(58, range=0..100)
# Create a circle that can orbit the original
# Add rotation angle to genome
vector_xyz = VectorXYZ(XComponent=number_slider_3, YComponent=number_slider_3, ZComponent=0)  # -> Vector, Length
number_slider_4 = Slider(4.224969, range=0..6.283185)
move = Move(Geometry=list_item, Motion=vector_xyz.Vector)  # -> Geometry, Transform
rotate = Rotate(Geometry=move.Geometry, Angle=number_slider_4, Plane=list_item)  # -> Geometry, Transform
circle_2 = Circle(Plane=rotate.Geometry, Radius=Slider(30, range=0..100))

# ----
# Check if rectangle intersects boundary lines
curve_curve = CurveCurve(CurveA=circle_2, CurveB=brep)  # -> Points, ParamsA, ParamsB
list_length = ListLength(List=curve_curve.Points)

# ----
# Check if circle intersects boundary lines
curve_curve_2 = CurveCurve(CurveA=circle, CurveB=brep)  # -> Points, ParamsA, ParamsB
list_length_2 = ListLength(List=curve_curve_2.Points)

# ----
# Check if circle intersects boundary
# lines, split stream such that only
# non-insersecting are returned
ghpython_script = GhPythonScript(x=list_length_2, y=list_item)  # -> out, a
# ---------- ghpython_script: Python ----------
__author__ = "peter"
__version__ = "2023.09.23"

import rhinoscriptsyntax as rs

if x > 1:
    a = False
else:
    a = True
# ---------- end ghpython_script ----------
stream_gate = StreamGate(Stream=list_item, Gate=ghpython_script.a)  # -> Target0, Target1

# ----
# Check if circle intersects boundary
# lines, split stream such that only
# non-insersecting are returned
ghpython_script_2 = GhPythonScript(x=list_length, y=list_item)  # -> out, a; same code as ghpython_script
stream_gate_2 = StreamGate(Stream=rotate.Geometry, Gate=ghpython_script_2.a)  # -> Target0, Target1

# ----
# Explode brep to
# individual curves
explode = Explode(Curve=brep, Recursive=True)  # -> Segments, Vertices

# ----
# Find distance to closest
# points on each boundary
# line, sum all distances
curve_closest_point = CurveClosestPoint(Point=stream_gate.Target1, Curve=explode.Segments)  # -> Point, Parameter, Distance

# ----
# Find distance to closest
# points on each boundary
# line, sum all distances
curve_closest_point_2 = CurveClosestPoint(Point=stream_gate_2.Target1, Curve=explode.Segments)  # -> Point, Parameter, Distance

merge = Merge(Data1=curve_closest_point.Distance, Data2=curve_closest_point_2.Distance)  # -> flatten(Result)

# ----
# Add secondary goal:
# orbiting circle distance
# to centroid
area = Area(Geometry=brep)  # -> Area, Centroid
distance = Distance(PointA=stream_gate_2.Target1, PointB=area.Centroid)

list_length_3 = ListLength(List=merge)
mass_addition = MassAddition(Input=merge)  # -> Result, PartialResults
ghpython_script_3 = GhPythonScript(x=list_length_3)  # -> out, a
# ---------- ghpython_script_3: Python ----------
__author__ = "peter"
__version__ = "2023.09.23"

import rhinoscriptsyntax as rs

if x > 6:
    a = x
else:
    a = 100000000000.0
# ---------- end ghpython_script_3 ----------
unit_y = UnitY(Factor="30")
addition = Addition(A=mass_addition.Result, B=ghpython_script_3.a)
move_2 = Move(Geometry=area.Centroid, Motion=unit_y)  # -> Geometry, Transform
sumofdistance = Number(expr("x * -1", addition))
distancetocentroid = Number(expr("x * -1", distance))
octopus = Octopus(OctopusData_gene=[number_slider_2, number_slider_4], OctopusData_obj=[sumofdistance, distancetocentroid])
text_tag = TextTag(Location=move_2.Geometry, Text=sumofdistance)
text_tag_2 = TextTag(Location=area.Centroid, Text=distancetocentroid)

# ---- group: Weighted Sum
weigth = Slider(1, range=0..10)
weigth_2 = Slider(3, range=0..10)
multiplication = Multiplication(A=weigth)
multiplication_2 = Multiplication(A=weigth_2)
addition_2 = Addition(A=multiplication_2, B=multiplication)
weigthed_sum = Panel(addition_2)
