# Grasshopper definition 230923_init_evo_test.gh (Grasshopper 1.0.7)

# ----
# Set boundary rep. for irregular shape(non-rect, non-circle)
geometry = Geometry([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])
join_curves = JoinCurves(Curves=geometry, Preserve=False)
brep = Brep(join_curves)

# ----
# Project brep to plane to ensure 2d points
xy_plane = XYPlane(Origin=Point(0, 0, 0))
project = Project(Geometry=brep, Plane=xy_plane)  # -> Geometry, Transform

# ----
# Create seed points for circle
number_slider = Slider(100, range=0..100)
populate_geometry = PopulateGeometry(Geometry=project.Geometry, Count=number_slider, Seed=1)

# ----
# Create circle at pt. in 2d population
# Point index
number_slider_2 = Slider(81, range=0..100)
list_item = ListItem(List=populate_geometry, Index=number_slider_2, Wrap=True)
circle = Circle(Plane=list_item, Radius=Slider(43, range=0..100))

# ----
# Check if circle intersects boundary lines
curve_curve = CurveCurve(CurveA=circle, CurveB=brep)  # -> Points, ParamsA, ParamsB
list_length = ListLength(List=curve_curve.Points)

# ----
# Explode brep to
# individual curves
explode = Explode(Curve=brep, Recursive=True)  # -> Segments, Vertices

# ----
# Check if circle intersects boundary
# lines, split stream such that only
# non-insersecting are returned
ghpython_script = GhPythonScript(x=list_length, y=list_item)  # -> out, a
# ---------- ghpython_script: Python ----------
__author__ = "peter"
__version__ = "2023.09.23"

import rhinoscriptsyntax as rs

if x > 1:
    a = False
else:
    a = True
# ---------- end ghpython_script ----------
stream_gate = StreamGate(Stream=list_item, Gate=ghpython_script.a)  # -> Target0, Target1

# ----
# Find distance to closest
# points on each boundary
# line, sum all distances
curve_closest_point = CurveClosestPoint(Point=stream_gate.Target1, Curve=explode.Segments)  # -> Point, Parameter, Distance
mass_addition = MassAddition(Input=curve_closest_point.Distance)  # -> Result, PartialResults

galapagos = Galapagos(fitness=mass_addition, gene=number_slider_2)
