# Grasshopper definition 230924_flex_test.gh (Grasshopper 1.0.7)
# plug-ins: FlexHopper, Wombat

geometry = Geometry([<curve referenced from the Rhino model> x507])
crv = Curve([<curve referenced from the Rhino model> x18])
join_curves = JoinCurves(Curves=crv, Preserve=False)
join_curves_2 = JoinCurves(Curves=geometry, Preserve=False)
divide_curve = DivideCurve(Curve=join_curves, Count=Slider(55, range=0..100), Kinks=False)  # -> Points, Tangents, Parameters
divide_curve_2 = DivideCurve(Curve=join_curves_2, Count=Slider(10, range=0..10), Kinks=False)  # -> Points, Tangents, Parameters
interpolate = Interpolate(Vertices=divide_curve.Points, Degree="1", Periodic=False, KnotStyle=1)  # -> flatten(Curve), Length, Domain
interpolate_2 = Interpolate(Vertices=divide_curve_2.Points, Degree="1", Periodic=Toggle(True), KnotStyle=1)  # -> flatten(Curve), Length, Domain
unit_z = UnitZ(Factor=Slider(10, range=0..10))
brep = Brep(interpolate_2.Curve)
brep_2 = Brep(brep)
extrude = Extrude(Base=brep_2, Direction=unit_z)
populate_2d = Populate2D(
    Region=[{Plane=PlaneXY(84930.51255, -65262.82556, 0), Size=Domain2(u=-94.89720286..94.89720286, v=-8.500563774..8.500563774)}, {Plane=PlaneXY(84899.29229, -65342.2672, 0), Size=Domain2(u=-100.1520968..100.1520968, v=-8.500563774..8.500563774)}, {Plane=PlaneXY(84805.16787, -65301.92816, 0), Size=Domain2(u=-16.53746043..16.53746043, v=-21.94691011..21.94691011)}],
    Count=Slider(5, range=0..100),
    Seed=1)  # -> flatten(Population)
populate_2d_2 = Populate2D(
    Region={Plane=PlaneXY(85370.65325, -65308.66022, 0), Size=Domain2(u=-64.28718551..64.28718551, v=-13.35195391..13.35195391)},
    Count=Slider(9, range=0..100),
    Seed=1)
extrude_as_mesh = ExtrudeAsMesh(Polyline=interpolate.Curve, Direction=unit_z, Cap=False)
mesh_brep = MeshBrep(
    Brep=extrude,
    Settings={GridMaxCount=0, GridMinCount=16, JaggedSeams=False, MaxEdgeLength=0, MinEdgeLength=0.0001, MinTolerance=0, Refine=True, RefineAngle=0, RelativeTolerance=0.65, SimplePlanes=True, Tolerance=0})
vector_xyz = VectorXYZ(XComponent=Slider(-3, range=-5..1), YComponent=Slider(0.1, range=0..0.1), ZComponent=0)  # -> Vector, Length
clean_tree = CleanTree(RemoveNulls=True, RemoveInvalid=True, RemoveEmpty=False, Tree=[mesh_brep, extrude_as_mesh])
multiplication = Multiplication(A=vector_xyz.Vector, B="-.5")
xy_plane = XYPlane(Origin=Point(0, 0, 0))
number_slider = Slider(18, range=0..100)
number_slider_2 = Slider(7, range=0..10)
boolean_toggle = BooleanToggle(True)
boolean_toggle_2 = BooleanToggle(True)
flex_collision_geometry = FlexCollisionGeometry(CollisionPlanes=flatten(xy_plane), CollisionMeshes=flatten(clean_tree))
multiplication_2 = Multiplication(A=number_slider, B=".7")
particles_from_points = ParticlesFromPoints(Points=populate_2d, Velocities=multiplication, Masses="1", SelfCollision=boolean_toggle, IsFluid=boolean_toggle_2)
particles_from_points_2 = ParticlesFromPoints(Points=populate_2d_2, Velocities=vector_xyz.Vector, Masses="1", SelfCollision=boolean_toggle, IsFluid=boolean_toggle_2)
parameters = FlexParametersFromValues(
    Gravity=Vector(0, 0, -9.81),
    Radius=number_slider,
    SolidRestDistance=0.15,
    FluidRestDistance=multiplication_2,
    CollisionDistance=0.075,
    ParticleCollisionMargin=0.5,
    ShapeCollisionMargin=0.5,
    MaxSpeed=3.402823466e+38,
    MaxAcceleration=100,
    DynamicFriction=0,
    StaticFriction=0,
    ParticleFriction=0,
    Restitution=0,
    Adhesion=0,
    SleepThreshold=0,
    ShockPropagation=0,
    Dissipation=0,
    Damping=0,
    Fluid=True,
    Viscosity=Slider(2.118, range=0..10),
    Cohesion=Slider(0, range=0..10),
    SurfaceTension=Slider(0, range=0..10),
    SolidPressure=1,
    FreeSurfaceDrag=0,
    Buoyancy=1,
    PlasticThreshold=0,
    PlasticCreep=0,
    Wind=Vector(0, 0, 0),
    Drag=0,
    Lift=0,
    RelaxationMode=True,
    RelaxationFactor=1)
flex_solver_options = FlexSolverOptions(
    TimeStep=Slider(0.2, range=0..1),
    SubSteps=3,
    NumIterations=3,
    SceneMode=0,
    FixedNumberOfIteration=-1,
    MemoryRequirements=[131072, 96, 65536, 65536, 65536, 65536, 65536, 196608, 131972],
    StabilityScale=1)
flex_scene = FlexScene(Particles=flatten([particles_from_points_2, particles_from_points]))
flex_engine = FlexEngine(
    FlexParams=parameters,
    FlexCollisionGeometry=flex_collision_geometry,
    FlexScene=flatten(flex_scene),
    FlexSolverOptions=flex_solver_options,
    Reset=Button(),
    Go=Toggle(False))  # -> FlexObject, Information
get_all_particles = GetAllParticles(FlexObject=flex_engine.FlexObject, N=1)  # -> Points, Vector
cloud_display = CloudDisplay(
    Points=get_all_particles.Points,
    Colours=ColourSwatch(SwatchColor=RGB(26, 249, 255)),
    Size=multiplication_2,
    SpriteType=0)
