# Grasshopper definition 230924_init_kangaroo_test.gh (Grasshopper 1.0.7)
# plug-ins: Kangaroo2 Components

geometry = Geometry([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])
number_slider = Slider(-0.001, range=-0.003..0.001)
construct_domain = ConstructDomain(DomainStart="-0.00001", DomainEnd="0.00001")
curve = Curve(geometry)
geometry_2 = Geometry([Point(85411.14244, -65301.86465, 0), Point(85418.5139, -65315.13326, 0), Point(85380.18233, -65319.851, 0), Point(85383.13092, -65297.73663, 0)])
join_curves = JoinCurves(Curves=curve, Preserve=False)
list_length = ListLength(List=geometry_2)
random = Random(Range=construct_domain, Number=list_length, Seed=2)
point = Point(geometry_2)
explode = Explode(Curve=join_curves, Recursive=True)  # -> Segments, Vertices
vector_xyz = VectorXYZ(XComponent="-.0001", YComponent=0, ZComponent=0)  # -> Vector, Length
interpolate = Interpolate(Vertices=explode.Vertices, Degree=Slider(1, range=0..1), Periodic=Toggle(True), KnotStyle=1)  # -> Curve, Length, Domain
load = Load(Point=geometry_2, ForceVector=vector_xyz.Vector, Weighting=1)
curvepointcollide = CurvePointCollide(Points=point, Curve=interpolate.Curve, Plane=PlaneXY(0, 0, 0), Interior=Toggle(True), Strength=".0000001")
length_line = LengthLine(Strength=10)
bouncysolver = BouncySolver(Reset=Button(), Threshold=1e-15, Tolerance=0.0001, Damping=0.99, Iterations=10, On=Toggle(True))  # -> I, V, O
point_2 = Point(bouncysolver.V)
