# Grasshopper definition 230924_kang_test_three.gh (Grasshopper 1.0.7)
# plug-ins: Kangaroo2 Components

crv = Curve([<curve referenced from the Rhino model> x18])
geometry = Geometry([<curve referenced from the Rhino model> x507])
join_curves = JoinCurves(Curves=crv, Preserve=False)
join_curves_2 = JoinCurves(Curves=geometry, Preserve=False)
divide_curve = DivideCurve(Curve=join_curves, Count=Slider(55, range=0..100), Kinks=False)  # -> Points, Tangents, Parameters
divide_curve_2 = DivideCurve(Curve=join_curves_2, Count=Slider(10, range=0..10), Kinks=False)  # -> Points, Tangents, Parameters
number_slider = Slider(7, range=0..10)
pop2d = Populate2D(
    Region={Plane=PlaneXY(85370.2559, -65302.86369, 0), Size=Domain2(u=-77.31345813..77.31345813, v=-23.023894..23.023894)},
    Count=Slider(10, range=0..10),
    Seed=1)
interpolate = Interpolate(Vertices=divide_curve.Points, Degree=3, Periodic=False, KnotStyle=1)  # -> Curve, Length, Domain
interpolate_2 = Interpolate(Vertices=divide_curve_2.Points, Degree="1", Periodic=Toggle(True), KnotStyle=1)  # -> flatten(Curve), Length, Domain
unit_x = UnitX(Factor=Slider(-0.01, range=-0.01..0.01))
offset = Offset(Curve=interpolate.Curve, Distance=expr("x * -1", number_slider), Plane=PlaneXY(0, 0, 0), Corners=1)
unit_z = UnitZ(Factor=Slider(10, range=0..10))
preview = CustomPreview(Geometry=join_curves, Shader=ColourSwatch(SwatchColor=RGB(26, 229, 0)))
Y = UnitY(Factor=0.01)
onplane = OnPlane(Points=pop2d, Plane=PlaneXY(0, 0, 0), Strength=1)
sc = SphereCollide(Points=pop2d, Radius=number_slider, Strength=10)
cpc = CurvePointCollide(Points=pop2d, Curve=offset, Plane=PlaneXY(0, 0, 0), Interior=Toggle(True), Strength=10)
load = Load(Point=pop2d, ForceVector=unit_x, Weighting=1)
brep = Brep(interpolate_2.Curve)
reset = Button()
on = BooleanToggle(True)
curve = Curve(interpolate_2.Curve)
brep_2 = Brep(brep)
curvepointcollide = CurvePointCollide(Points=pop2d, Curve=curve, Plane=PlaneXY(0, 0, 0), Interior=False, Strength=1)  # disabled
extrude = Extrude(Base=brep_2, Direction=unit_z)  # -> graft(Extrusion)
solidpointcollide = SolidPointCollide(Points=pop2d, Solid=extrude, Interior=False, Unidirectional=True, Strength=1)
bouncysolver = BouncySolver(
    GoalObjects=[load, cpc, onplane, sc, solidpointcollide],
    Reset=reset,
    Threshold=1e-15,
    Tolerance=0.0001,
    Damping=0.99,
    Iterations=10,
    On=on)  # -> I, V, O
panel = Panel(extrude)
sphere = Sphere(Base=bouncysolver.V, Radius=number_slider)
