# Grasshopper definition 230928_circle_pack_lighting.gh (Grasshopper 1.0.7)
# plug-ins: Wombat, LunchBox, Kangaroo2 Components

geometry = Geometry(<curve referenced from the Rhino model>)
# Create Point Population
join_curves = JoinCurves(Curves=geometry, Preserve=False)
populate_2d = Populate2D(Region=join_curves, Count=Slider(341, range=0..1000), Seed=Slider(100, range=0..100))

foot_inch_to_decimal_foot = FootInchToDecimalFoot(FormattedValue="1'0\"")  # -> ValueInFeet, ValueInInches, ValueInDocumentUnits
random_split_list = RandomSplitList(MasterList=populate_2d, Seed=Slider(1000, range=0..1000), Split=Slider(0.3, range=0..1))  # -> ListA, ListB
foot_inch_to_decimal_foot_2 = FootInchToDecimalFoot(FormattedValue="0'6\"")  # -> ValueInFeet, ValueInInches, ValueInDocumentUnits
foot_inch_to_decimal_foot_3 = FootInchToDecimalFoot(FormattedValue="0'4\"")  # -> ValueInFeet, ValueInInches, ValueInDocumentUnits
foot_inch_to_decimal_foot_4 = FootInchToDecimalFoot(FormattedValue="0'8\"")  # -> ValueInFeet, ValueInInches, ValueInDocumentUnits
random_split_list_2 = RandomSplitList(MasterList=random_split_list.ListA, Seed=2, Split=Slider(0.2, range=0..1))  # -> ListA, ListB
random_split_list_3 = RandomSplitList(MasterList=random_split_list.ListB, Seed=2, Split=Slider(0.8, range=0..1))  # -> ListA, ListB
multiplication = Multiplication(A=foot_inch_to_decimal_foot_4.ValueInInches, B=Slider(0.5, range=0..1))
multiplication_2 = Multiplication(A=foot_inch_to_decimal_foot_2.ValueInInches, B=Slider(0.5, range=0..1))
multiplication_3 = Multiplication(A=foot_inch_to_decimal_foot.ValueInInches, B=Slider(0.5, range=0..1))
multiplication_4 = Multiplication(A=foot_inch_to_decimal_foot_3.ValueInInches, B=Slider(0.5, range=0..1))
merge = Merge(Data1=foot_inch_to_decimal_foot_4.ValueInInches, Data2=multiplication)  # -> graft(Result)
circle = Circle(Plane=random_split_list_3.ListA, Radius=merge)
merge_2 = Merge(Data1=foot_inch_to_decimal_foot.ValueInInches, Data2=multiplication_3)  # -> graft(Result)
circle_2 = Circle(Plane=random_split_list_3.ListB, Radius=merge_2)
merge_3 = Merge(Data1=foot_inch_to_decimal_foot_2.ValueInInches, Data2=multiplication_2)  # -> graft(Result)
circle_3 = Circle(Plane=random_split_list_2.ListB, Radius=merge_3)
merge_4 = Merge(Data1=foot_inch_to_decimal_foot_3.ValueInInches, Data2=multiplication_4)  # -> graft(Result)
circle_4 = Circle(Plane=random_split_list_2.ListA, Radius=merge_4)
area = Area(Geometry=circle_4)  # -> Area, flatten(Centroid)
area_2 = Area(Geometry=circle_3)  # -> Area, flatten(Centroid)
line = Line(EndPoint=area_2.Centroid)
length_line = LengthLine(Strength=10)
