# Grasshopper definition 230928_circle_pack_lighting_3.gh (Grasshopper 1.0.7)
# plug-ins: Kangaroo2 Components

# ---- group: Number of circles
genes = GenePool(Decimals=0, Maximum=100, Minimum=0, Value=[56, 48, 61, 28, 67])

# ----
outer_circle_radius = Slider(50, range=0..100)
genes_2 = GenePool(Decimals=2, Maximum=30, Minimum=0, Value=[4.03, 6.05, 7.99, 12.12])
geometry = Geometry(<curve referenced from the Rhino model>)
lng = ListLength(List=genes)
div = DivideDomain(Domain=Domain(0, 1), Count=lng)
deconstruct_brep = DeconstructBrep(Brep=geometry)  # -> Faces, Edges, Vertices
repeat = RepeatData(Data=graft(genes_2), Length=graft(genes))
dedomain = DeconstructDomain(Domain=div)  # -> Start, End
lng_2 = ListLength(List=repeat)
hsl = ColourHSL(Alpha=1, Hue=dedomain.Start, Saturation=Slider(0.36, range=0..1), Luminance=0.5)
length = Length(Curve=deconstruct_brep.Edges)
boundary = BoundarySurfaces(Edges=geometry)
enum_tree = EnumerateTreeBranches(T=lng_2)  # -> T; inputs T: tree
# ---------- enum_tree: Python ----------
from Grasshopper import DataTree
T2 = DataTree[object]()
for i, path in enumerate(T.Paths):
  T2.Add(i, path)
T = T2
# ---------- end enum_tree ----------
area = Area(Geometry=geometry)  # -> Area, Centroid
repeat_2 = RepeatData(Data=graft(hsl), Length=graft(genes))
popgeo = PopulateGeometry(Geometry=boundary, Count=lng_2, Seed=enum_tree)
clamplength = ClampLength(Line=deconstruct_brep.Edges, LowerLimit=0, UpperLimit=length, Strength=1)
collider = Collider(Objects=flatten(popgeo), Radii=flatten(repeat), Strength=1)
grab = Grab(On=True, Strength=1, Range=3)  # -> Grab, Anchors
onplane = OnPlane(Points=popgeo, Plane=PlaneXY(0, 0, 0), Strength=1)
anchor = Anchor(Point=area.Centroid, Strength=10000)
show = Show(G=popgeo)
merge = Merge(Data1=anchor, Data2=onplane, Data3=grab.Grab, Data4=clamplength, Data5=collider)
entwine = Entwine(Branch0X=flatten(merge), Branch1X=show, FlattenInputs=False)
solver = Solver(GoalObjects=entwine, Reset=Button(), Threshold=1e-15, Tolerance=0.01, On=Toggle(False))  # -> I, V, O
split = SplitTree(Data=solver.O, Masks=flatten("{0;0}"))  # -> Positive, Negative
circle = CircleCNR(Center=split.Negative, Normal=Vector(0, 0, 1), Radius=repeat)
pt = Point(split.Negative)
boundary_2 = BoundarySurfaces(Edges=circle)
preview = CustomPreview(Geometry=boundary_2, Shader=repeat_2)
