# Grasshopper definition 230928_circle_pack_lighting_python.gh (Grasshopper 1.0.7)

geometry = Geometry(<curve referenced from the Rhino model>)
deconstruct_brep = DeconstructBrep(Brep=geometry)  # -> Faces, Edges, flatten(Vertices)
deconstruct = Deconstruct(Point=deconstruct_brep.Vertices)  # -> flatten(XComponent), flatten(YComponent), ZComponent
panel = Panel(deconstruct.XComponent)
number_slider = Slider(162, range=0..1000)
ghpython_script = GhPythonScript(x=panel, y=deconstruct.YComponent)  # -> out, x_min, x_max, y_min, y_max; inputs x: list, y: list
# ---------- ghpython_script: Python ----------
__author__ = "peter"
__version__ = "2023.09.28"

import rhinoscriptsyntax as rs

x_min = float(min(x))
x_max = float(max(x))
y_min = float(min(y))
y_max = float(max(y))
# ---------- end ghpython_script ----------
integer = Integer(number_slider)
ghpython_script_2 = GhPythonScript(
    x=integer,
    x_min=ghpython_script.x_min,
    x_max=ghpython_script.x_max,
    y_min=ghpython_script.y_min,
    y_max=ghpython_script.y_max)  # -> out, a, points_out, circles_out, tangent_pairs_out, objective_value_out
# ---------- ghpython_script_2: Python ----------
__author__ = "peter"
__version__ = "2023.09.28"

import rhinoscriptsyntax as rs

import random
import Rhino.Geometry as rg


# Initialize variables
num_points = 1000  # Number of random points to generate
x_range = (x_min, x_max)  # X-coordinate range for random points
y_range = (y_min, y_max)  # Y-coordinate range for random points
circle_sizes = [8, 12, 16, 20]  # Possible circle sizes (radii)
tolerance = 1e-5  # Tolerance for checking tangency

# Generate random points
points = [rg.Point3d(random.uniform(x_range[0], x_range[1]), random.uniform(y_range[0], y_range[1]), 0) for _ in range(num_points)]

# Generate circles at random points with random sizes
circles = [rg.Circle(pt, random.choice(circle_sizes)) for pt in points]

# Initialize list to store pairs of tangent circles
tangent_pairs = []

# Check for tangency between all pairs of circles
for i in range(len(circles)):
    for j in range(i + 1, len(circles)):
        circle1 = circles[i]
        circle2 = circles[j]
        
        # Calculate distance between circle centers
        distance = circle1.Center.DistanceTo(circle2.Center)
        
        # Check for external tangency
        if abs(distance - (circle1.Radius + circle2.Radius)) < tolerance:
            tangent_pairs.append((i, j))
            continue  # Skip the next check if external tangency is found
        
        # Check for internal tangency
        if abs(distance - abs(circle1.Radius - circle2.Radius)) < tolerance:
            tangent_pairs.append((i, j))

# Define objective function for Galapagos (e.g., maximize number of tangent pairs)
objective_value = len(tangent_pairs)

# Output
# The following variables will be output in Grasshopper
# 'points_out' will contain the generated random points
# 'circles_out' will contain the generated circles
# 'tangent_pairs_out' will contain the indices of tangent circle pairs
# 'objective_value_out' will contain the objective value to be optimized by Galapagos

points_out = points
circles_out = circles
tangent_pairs_out = tangent_pairs
objective_value_out = objective_value
# ---------- end ghpython_script_2 ----------
integer_2 = Integer(ghpython_script_2.objective_value_out)
galapagos = Galapagos(fitness=ghpython_script_2, gene=number_slider)
