# Grasshopper definition 230928_circle_pack_lighting_python_c_sharp.gh (Grasshopper 1.0.7)
# plug-ins: Kangaroo2 Components

geometry = Geometry(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)
rectangle = Rectangle(geometry)
populate_2d = Populate2D(Region=rectangle, Count=Slider(220, range=0..300), Seed=1)
gene_pool = GenePool(Decimals=0, Maximum=24, Minimum=0, Value=[7, 9, 13, 17])
list_length = ListLength(List=populate_2d)
ghpython_script = GhPythonScript(x=list_length, y=gene_pool)  # -> out, a; inputs x: list, y: list
# ---------- ghpython_script: Python ----------
__author__ = "peter"
__version__ = "2023.09.28"

import rhinoscriptsyntax as rs
import random

my_list = y


random_values = [random.choice(my_list) for i in range(x[0])]

a = random_values

print(y)
# ---------- end ghpython_script ----------
circle = Circle(Plane=populate_2d, Radius=ghpython_script.a)
crv_outer_circles = Curve(circle)
area = Area(Geometry=crv_outer_circles)  # -> Area, Centroid
darc = DeconstructArc(Arc=crv_outer_circles)  # -> BasePlane, Radius, Angle
list_length_2 = ListLength(List=gene_pool)
divide_domain = DivideDomain(Domain=Domain(0, 1), Count=list_length_2)
spherecurvecollide = CSharpScript(
    C=rectangle,
    Pts=area.Centroid,
    Radii=darc.Radius,
    Strength=1,
    Reference="C:\Program Files\Rhino 7\Plug-ins\Grasshopper\Components\KangarooSolver.dll")  # -> out, flatten(A); inputs C: Curve, Pts: list of Point3d, Radii: list of Double, Strength: Double
# ---------- spherecurvecollide: C# usings ----------
using System.IO;
using System.Linq;
using System.Data;
using System.Drawing;
using System.Reflection;
using System.Windows.Forms;
using System.Xml;
using System.Xml.Linq;
using System.Runtime.InteropServices;

using Rhino.DocObjects;
using Rhino.Collections;
using GH_IO;
using GH_IO.Serialization;
using KPlankton;
using KangarooSolver;
using KangarooSolver.Goals;
# ---------- spherecurvecollide: C# ----------
    A = new SphereCurveCollide(C, Pts, Radii, Strength);
# ---------- spherecurvecollide: C# additional code ----------
  public class SphereCurveCollide : GoalObject
  {
    Curve C;
    double strength;
    double[] radii;

    public SphereCurveCollide(Curve Crv, List<Point3d> Pts, List<double> Radii, double k)
    {
      C = Crv;
      int L = Pts.Count;
      PPos = Pts.ToArray();
      Move = new Vector3d[L];
      Weighting = new double[L];
      radii = Radii.ToArray();
      strength = k;
    }

    public override void Calculate(List<KangarooSolver.Particle> p)
    {
      for (int i = 0; i < PIndex.Length; i++)
      {
        Point3d Pt = p[PIndex[i]].Position;

        var containment0 = C.Contains(Pt, Plane.WorldXY, 0);
        var containment1 = C.Contains(Pt, Plane.WorldXY, radii[i]);

        if (containment0 == PointContainment.Outside)
        {
          double t = new double();
          C.ClosestPoint(Pt, out t);
          Move[i] = C.PointAt(t) - Pt;
          Weighting[i] = strength;
        }
        else if (containment1 != PointContainment.Inside)
        {
          double t = new double();
          C.ClosestPoint(Pt, out t, radii[i]);
          Point3d Closest = C.PointAt(t);
          Vector3d Push = Pt - Closest;
          Push.Unitize();
          Push *= radii[i];
          Point3d Target = Closest + Push;
          Move[i] = Target - Pt;
          Weighting[i] = strength;
        }
        else { Move[i] = Vector3d.Zero; Weighting[i] = 0; }
      }

    }
  }
# ---------- end spherecurvecollide ----------
onplane = OnPlane(Points=area.Centroid, Plane=PlaneXY(0, 0, 0), Strength=10)
grab = Grab(On=True, Strength=1000, Range=111)
collider = Collider(Objects=area.Centroid, Radii=darc.Radius, Strength=10)
show = Show(G=area.Centroid)
number_slider = Slider(0.9, range=0..1)
deconstruct_domain = DeconstructDomain(Domain=divide_domain)  # -> Start, End
solver = Solver(
    GoalObjects=[show, onplane, spherecurvecollide.A, collider, grab],
    Reset=Button(),
    Threshold=1e-15,
    Tolerance=0.01,
    On=Toggle(True))  # -> I, V, O
colour_hsl = ColourHSL(Alpha=1, Hue=deconstruct_domain.Start, Saturation=Slider(0.37, range=0..1), Luminance=0.5)
dot = DotDisplay(Point=solver.V)
cir = Circle(Plane=solver.V, Radius=darc.Radius)
boundary_surfaces = BoundarySurfaces(Edges=cir)  # disabled
list_length_3 = ListLength(List=boundary_surfaces)
repeat_data = RepeatData(Data=flatten(colour_hsl), Length=flatten(list_length_3))
panel = Panel(repeat_data)
custom_preview = CustomPreview(Geometry=flatten(boundary_surfaces), Material=flatten(repeat_data))
