# Grasshopper definition 231004_kangaroo_bar.gh (Grasshopper 1.0.7)
# plug-ins: Kangaroo2 Components

geometry = Geometry([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])
join_curves = JoinCurves(Curves=geometry, Preserve=False)
number_slider = Slider(1.46, range=0..3)
number_slider_2 = Slider(0.44, range=0..1)
area = Area(Geometry=join_curves)  # -> Area, Centroid
boundary_surfaces = BoundarySurfaces(Edges=join_curves)
area_2 = Area(Geometry=boundary_surfaces)  # -> Area, Centroid
rectangle = Rectangle(Plane=area.Centroid, XSize=Domain(-1, 1), YSize=Domain(-2, 2), Radius=0)  # -> Rectangle, Length
construct_domain = ConstructDomain(DomainStart=expr("x*-1", number_slider_2), DomainEnd=number_slider_2)
construct_domain_2 = ConstructDomain(DomainStart=expr("x*-1", number_slider), DomainEnd=number_slider)
rectangle_2 = Rectangle(Plane=area_2.Centroid, XSize=construct_domain, YSize=construct_domain_2, Radius=0)  # -> Rectangle, Length
populate_geometry = PopulateGeometry(Geometry=boundary_surfaces, Count=Slider(50, range=0..100), Seed=1)
brep = Brep(rectangle_2.Rectangle)
circle = Circle(Plane=populate_geometry, Radius=".5")
box = Box(rectangle_2.Rectangle)
grab = Grab(On=True, Strength=1, Range=3)
solidpointcollide = SolidPointCollide(Points=populate_geometry, Solid=box, Interior=False, Unidirectional=True, Strength=1)
collider = Collider(Objects=populate_geometry, Radii=".5", Strength=1)
onplane = OnPlane(Points=populate_geometry, Plane=PlaneXY(0, 0, 0), Strength=1)
solver = Solver(
    GoalObjects=[onplane, collider, grab, solidpointcollide],
    Reset=Button(),
    Threshold=1e-15,
    Tolerance=0.0001,
    On=Toggle(True))  # -> I, V, O
circle_2 = Circle(Plane=solver.V, Radius=".5")
