# Grasshopper definition 231004_magnetizing_fp_upstairs_2.gh (Grasshopper 1.0.7)
# plug-ins: Magnetizing_FPG

roominstance = RoomInstance()
roominstance_2 = RoomInstance()
roominstance_3 = RoomInstance()
roominstance_4 = RoomInstance()
crv = Curve(<curve referenced from the Rhino model>)
pt = Point(Point(2111.066522, -1682.706635, -4.972584987e-11))
roominstance_5 = RoomInstance()
houseinstance = HouseInstance(Boundary=crv, EntrancePoint=pt)
roominstance_6 = RoomInstance()
roominstance_7 = RoomInstance()
magnetizing_fpg = MagnetizingRooms_ES(HouseInstance=houseinstance, Iterations="300", MaxAdjDistance="2", CellSizeM=1)  # -> Corridors, RoomBreps, RoomNames, Adjacencies, MissingAdjacences, Boundary, BoundaryOffset
split = TextSplit(Text=magnetizing_fpg.Adjacencies, Separators="-")  # -> flatten(Result)
lng = ListLength(List=magnetizing_fpg.RoomBreps)
shift = ShiftList(List=split, Shift=-1, Wrap=False)
area = Area(Geometry=magnetizing_fpg.RoomBreps)  # -> Area, Centroid
random = Random(Range=Domain(0, 1), Number=lng, Seed=2)
dispatch = Dispatch(List=shift, DispatchPattern=[True, False])  # -> ListA, ListB
item = ListItem(List=area.Centroid, Index=dispatch.ListA, Wrap=True)
item_2 = ListItem(List=area.Centroid, Index=dispatch.ListB, Wrap=True)
gradient = Gradient(
    LowerLimit=0,
    UpperLimit=1,
    Parameter=random,
    stops=[0: RGB(243, 57, 0), 0.1: RGB(236, 27, 60), 0.2: RGB(210, 0, 118), 0.3: RGB(103, 0, 120), 0.4: RGB(39, 72, 161), 0.5: RGB(1, 192, 229), 0.6: RGB(18, 178, 90), 0.7: RGB(79, 186, 8), 0.8: RGB(220, 237, 32), 0.9: RGB(247, 159, 20), 1: RGB(243, 57, 0)])
ln = Line(StartPoint=item, EndPoint=item_2)
preview = CustomPreview(Geometry=magnetizing_fpg.BoundaryOffset, Material=ColourSwatch(SwatchColor=RGB(176, 176, 176)))
preview_2 = CustomPreview(Geometry=ln, Material=ColourSwatch(SwatchColor=RGB(0, 0, 0)))
preview_3 = CustomPreview(Geometry=magnetizing_fpg.RoomBreps, Material=gradient)
preview_4 = CustomPreview(
    Geometry=magnetizing_fpg.Corridors,
    Material={diffuse=RGB(221, 160, 221), emission=RGB(66, 48, 66), shine=0.5, specular=RGB(255, 255, 255), transparency=0})
tag = TextTag(Location=area.Centroid, Text=magnetizing_fpg.RoomNames, Colour=RGB(0, 0, 0))
