# Grasshopper definition 231011_bar_size_locatino.gh (Grasshopper 1.0.7)

geometry = Geometry([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])
curve = Curve(geometry)
join_curves = JoinCurves(Curves=curve, Preserve=False)
ghpython_script = GhPythonScript()  # -> out, a, num_angles
# ---------- ghpython_script: Python ----------
__author__ = "peter"
__version__ = "2023.10.11"

import rhinoscriptsyntax as rs

rotation_angles = range(0, 360, 45)
a = rotation_angles
num_angles = len(a)
# ---------- end ghpython_script ----------
boundary_surfaces = BoundarySurfaces(Edges=join_curves)
multiplication = Multiplication(A=Slider(24, range=16..24), B="12\t")
list_item = ListItem(List=ghpython_script.a, Index=Slider(7, range=0..8), Wrap=True)
populate_geometry = PopulateGeometry(Geometry=boundary_surfaces, Count=Slider(100, range=0..100), Seed=1)
radians = Radians(Degrees=list_item)
list_item_2 = ListItem(List=populate_geometry, Index=Slider(62, range=0..100), Wrap=True)
rectangle = Rectangle(Plane=list_item_2, XSize=multiplication, YSize="24", Radius=0)  # -> Rectangle, Length
rotate = Rotate(Geometry=rectangle.Rectangle, Angle=radians, Plane=list_item_2)  # -> Geometry, Transform
deconstruct_brep = DeconstructBrep(Brep=rotate.Geometry)  # -> Faces, Edges, flatten(Vertices)

# ----
# Get Random Index
ghpython_script_2 = GhPythonScript(x=deconstruct_brep.Vertices)  # -> out, flatten(a); inputs x: list
# ---------- ghpython_script_2: Python ----------
__author__ = "peter"
__version__ = "2023.10.11"

import rhinoscriptsyntax as rs
import random

# List of vertices from the Brep
vertices = x

# Get a random index
random_index = random.randint(0, len(vertices) - 1)

# Output the random index
a = vertices[random_index]
# ---------- end ghpython_script_2 ----------

area = Area(Geometry=rotate.Geometry)  # -> Area, Centroid
multiplication_2 = Multiplication(A=Slider(5, range=3..5), B="12")
point = Point(ghpython_script_2.a)
rectangle_2 = Rectangle(Plane=point, XSize="24", YSize=multiplication_2, Radius=0)  # -> Rectangle, Length
yz_plane = YZPlane(Origin=area.Centroid)
construct_plane = ConstructPlane(Origin=area.Centroid, XAxis=Vector(1, 0, 0), YAxis=Vector(0, 1, 0))
rotate_2 = Rotate(Geometry=rectangle_2.Rectangle, Angle=radians, Plane=point)  # -> Geometry, Transform
stream_gate = StreamGate(Stream=rotate_2.Geometry, Gate=Slider(0, range=0..1))  # -> Target0, Target1
stream_gate_2 = StreamGate(Stream=rectangle_2.Rectangle, Gate=Slider(0, range=0..1))  # -> Target0, Target1
mirror = Mirror(Geometry=stream_gate.Target0, Plane=construct_plane)  # -> Geometry, Transform
geometry_2 = Geometry(stream_gate_2.Target0)
