# Grasshopper definition 231011_bar_size_location_part_2.gh (Grasshopper 1.0.7)
# plug-ins: Wombat, Pufferfish, Anemone

geometry = Geometry([<curve referenced from the Rhino model> x10])
curve = Curve(geometry)
join_curves = JoinCurves(Curves=curve, Preserve=False)
boundary_surfaces = BoundarySurfaces(Edges=join_curves)
divide_surface = DivideSurface(Surface=boundary_surfaces, UCount=Slider(20, range=0..100), VCount=Slider(15, range=0..100))  # -> flatten(Points), Normals, Parameters
number_slider = Slider(44, range=32..48)
number_slider_2 = Slider(8, range=0..100)
populate_geometry = PopulateGeometry(Geometry=boundary_surfaces, Count=Slider(100, range=0..100), Seed=1)
clean_tree = CleanTree(RemoveNulls=True, RemoveInvalid=True, RemoveEmpty=False, Tree=divide_surface.Points)
division = Division(A=number_slider, B="2")

list_length = ListLength(List=clean_tree)
# Random Shuffle
random = Random(Range=Domain(0, 1), Number=list_length, Seed=2)
sort_list = SortList(Keys=random, ValuesValuesA=clean_tree)  # -> Keys, ValuesValuesA

multiplication = Multiplication(A=division, B="12")
ghpython_script = GhPythonScript()  # -> out, a, num_angles
# ---------- ghpython_script: Python ----------
__author__ = "peter"
__version__ = "2023.10.11"

import rhinoscriptsyntax as rs

rotation_angles = range(0, 360, 45)
a = rotation_angles
num_angles = len(a)
# ---------- end ghpython_script ----------
rotation_index = Slider(5, range=0..8)
multiplication_2 = Multiplication(A="9", B="12")
division_2 = Division(A=multiplication, B="2")
number_slider_3 = Slider(2, range=2..8)

list_length_2 = ListLength(List=ghpython_script.a)
# Random Shuffle
random_2 = Random(Range=Domain(0, 1), Number=list_length_2, Seed=2)
sort_list_2 = SortList(Keys=random_2, ValuesValuesA=ghpython_script.a)  # -> Keys, ValuesValuesA

division_3 = Division(A=multiplication_2, B="2")
construct_domain = ConstructDomain(DomainStart=expr("x*-1", division_2), DomainEnd=division_2)
list_item = ListItem(List=sort_list.ValuesValuesA, Index=number_slider_2, Wrap=True)
list_item_2 = ListItem(List=sort_list_2.ValuesValuesA, Index=rotation_index, Wrap=True)
# L and U Depth
division_4 = Division(A=number_slider_3, B="2")
radians = Radians(Degrees=list_item_2)
multiplication_3 = Multiplication(A=division_4, B="12")
construct_domain_2 = ConstructDomain(DomainStart=expr("x*-1", division_3), DomainEnd=multiplication_3)
rotate_plane = RotatePlane(Plane=list_item, Angle=radians)
l_u_1 = Slider(0, range=0..1)
l_u_2 = Slider(0, range=0..1)
number_slider_4 = Slider(0, range=0..1)
number_slider_5 = Slider(0, range=0..1)

# ----
# Randint 0 1
ghpython_script_2 = GhPythonScript(x=number_slider_4)  # -> out, a
# ---------- ghpython_script_2: Python ----------
__author__ = "peter"
__version__ = "2023.10.12"

import rhinoscriptsyntax as rs
import random

if x:
    a = random.randint(0,1)
# ---------- end ghpython_script_2 ----------

# ----
# Randint 0 1
ghpython_script_3 = GhPythonScript(x=number_slider_5)  # -> out, a; same code as ghpython_script_2

rectangle = Rectangle(Plane=rotate_plane, XSize=construct_domain, YSize=construct_domain_2, Radius=0)  # -> Rectangle, Length
offset_curve = OffsetCurve(Curve=rectangle.Rectangle, Distance="-24", Corners=1)
ghpython_script_4 = GhPythonScript(x=ghpython_script_2.a)  # -> out, a
# ---------- ghpython_script_4: Python ----------
__author__ = "peter"
__version__ = "2023.10.11"

import rhinoscriptsyntax as rs

if x == 1:
    a = 100
else:
    a = 0
# ---------- end ghpython_script_4 ----------
ghpython_script_5 = GhPythonScript(x=ghpython_script_3.a)  # -> out, a; same code as ghpython_script_4
boundary_surfaces_2 = BoundarySurfaces(Edges=offset_curve)
extend_surface = ExtendSurface(
    Surface=boundary_surfaces_2,
    WestEdge=ghpython_script_5.a,
    SouthEdge=0,
    EastEdge=ghpython_script_4.a,
    NorthEdge=Slider(100, range=0..100),
    ExtensionType=True)
boundary_surfaces_3 = BoundarySurfaces(Edges=rectangle.Rectangle)
deconstruct_brep = DeconstructBrep(Brep=extend_surface)  # -> Faces, Edges, Vertices
surface_split = SurfaceSplit(Surface=boundary_surfaces_3, Curves=deconstruct_brep.Edges)
list_item_3 = ListItem(List=surface_split, Index="1", Wrap=True)
curve_curve = CurveCurve(CurveA=list_item_3, CurveB=join_curves)  # -> Points, ParamsA, ParamsB
ghpython_script_6 = GhPythonScript(x=curve_curve.Points)  # -> out, a, b; inputs x: list
# ---------- ghpython_script_6: Python ----------
__author__ = "peter"
__version__ = "2023.10.11"

import rhinoscriptsyntax as rs

if x:
    a = True
    b = 1
else:
    a = False
    b = 0
# ---------- end ghpython_script_6 ----------
dispatch = Dispatch(List=list_item_3, DispatchPattern=ghpython_script_6.a)  # -> ListA, ListB
region_intersection = RegionIntersection(CurvesA=dispatch.ListB, CurvesB=join_curves)
galapagos = Galapagos(fitness=number, gene=[number_slider_2, number_slider_3, number_slider, number_slider_5, number_slider_4, rotation_index])
ghpython_script_7 = GhPythonScript(x=region_intersection)  # -> out, a, b; inputs x: list; same code as ghpython_script_6
invert_boolean = InvertBoolean(Boolean=ghpython_script_7.a)  # -> Inverted, Number
dispatch_2 = Dispatch(List=dispatch.ListB, DispatchPattern=invert_boolean.Inverted)  # -> ListA, ListB
number = Number(ghpython_script_7.b)
geometry_2 = Geometry(dispatch_2.ListB)
data_recorder = DataRecorder(geometry_2, DataLimit=-10, RecordData=True)
stream_gate = StreamGate(Stream=data_recorder, Gate=Toggle(True))  # -> Target0, Target1
flatten_tree = FlattenTree(Tree=join_curves, Path="{0}")
flatten_tree_2 = FlattenTree(Tree=data_recorder, Path="{0}")
list_length_3 = ListLength(List=flatten_tree_2)
flatten_tree_3 = FlattenTree(Tree=stream_gate.Target1, Path="{0}")  # -> flatten(Tree)
list_length_4 = ListLength(List=flatten_tree_3)
series = Series(Start=0, Step=1, Count=list_length_3)
graft_tree = GraftTree(Tree=flatten_tree_2, IncludeEmptyLists=True, IncludeNullItems=True)
list_item_4 = ListItem(List=flatten_tree, Index=series, Wrap=True)  # -> flatten(Item)
loop_start = LoopStart(Repeat=list_length_4, Trigger=Button(), Data=flatten_tree_3)  # -> port, Counter, Data
graft_tree_2 = GraftTree(Tree=list_item_4, IncludeEmptyLists=True, IncludeNullItems=True)
panel = Panel(graft_tree)
merge = Merge(Data1=graft_tree_2, Data2=graft_tree)
list_item_5 = ListItem(List=flatten_tree_3, Index=loop_start.Counter, Wrap=True)
boolean = Boolean(list_item_5)
panel_2 = Panel(merge)
item_index = ItemIndex(List=flatten_tree_3, Item=list_item_5)
ghpython_script_8 = GhPythonScript(x=loop_start.Counter, y=rotation_index)  # -> out, a
# ---------- ghpython_script_8: Python ----------
__author__ = "peter"
__version__ = "2023.10.12"

import rhinoscriptsyntax as rs

a = str(int(x)) + "_" + str(int(y))
print(a)
# ---------- end ghpython_script_8 ----------
loop_end = LoopEnd(port=loop_start.port, Exit=Toggle(False), Data=item_index, TimeOutVal=0, pausedState=False, state="Constant output")
captureview = LBCaptureView(
    file_name=ghpython_script_8.a,
    folder="C:\Users\peter\Downloads\gh_bar_test\outputs_larger",
    viewport="bar_area",
    capture=boolean)  # -> Output; plug-in component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
