# Grasshopper definition upstairs_bar_evo_location.gh (Grasshopper 1.0.7)

geometry = Geometry([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])
join_curves = JoinCurves(Curves=geometry, Preserve=False)
area = Area(Geometry=join_curves)  # -> Area, Centroid

number_slider = Slider(15, range=0..100)
number_slider_2 = Slider(60, range=0..100)
construct_domain = ConstructDomain(DomainStart=expr("x*-1", number_slider), DomainEnd=number_slider)
# Construct Rectangle at Centroid
construct_domain_2 = ConstructDomain(DomainStart=expr("x*-1", number_slider_2), DomainEnd=number_slider_2)
rectangle = Rectangle(Plane=area.Centroid, XSize=construct_domain_2, YSize=construct_domain, Radius=0)  # -> Rectangle, Length

# ----
# Construct Rectangle at Random Vertex of Main Rectangle
deconstruct_brep = DeconstructBrep(Brep=rectangle.Rectangle)  # -> Faces, Edges, Vertices
list_item = ListItem(List=deconstruct_brep.Vertices, Index=Slider(3, range=0..3), Wrap=True)
multiplication = Multiplication(A=number_slider, B="2")
rectangle_2 = Rectangle(Plane=list_item, XSize=multiplication, YSize=Slider(70, range=0..100), Radius=0)  # -> Rectangle, Length

deconstruct_brep_2 = DeconstructBrep(Brep=rectangle_2.Rectangle)  # -> Faces, Edges, Vertices
relay = Relay()
