# Grasshopper definition room_rearrange.gh (Grasshopper 1.0.7)

geometry = Geometry([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])
vector_xyz = VectorXYZ(XComponent=Slider(4, range=0..10), YComponent=Slider(5, range=0..10), ZComponent=0)  # -> Vector, Length
boolean_toggle = BooleanToggle(True)
geometry_2 = Geometry(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)
geometry_3 = Geometry(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)
stretch = Stretch(Geometry=geometry, Axis=geometry_2, Length=Slider(30, range=0..100), Rigid=boolean_toggle)
stretch_2 = Stretch(Geometry=stretch, Axis=geometry_3, Length=Slider(26, range=0..100), Rigid=boolean_toggle)
move = Move(Geometry=stretch_2, Motion=vector_xyz.Vector)  # -> Geometry, Transform
