# Grasshopper definition paneling.gh (Grasshopper 1.0.7)
# plug-ins: PTComponentLibrary

number_slider = Slider(90, range=0..100)
unit_z = UnitZ(Factor=1)
geometry = Geometry(Point(-9.464822205, -1.004375076, 0))
unit_y = UnitY(Factor=1)
planar_grid = PlanarGrid(
    BasePoint=geometry,
    IDir=unit_y,
    JDir=unit_z,
    IDistance=Slider(2.5, range=0..10),
    JDistance=Slider(3.3, range=0..100),
    INumber=Slider(2, range=0..10),
    JNumber=Slider(5, range=0..10))
