# Grasshopper definition fieldview-brep-veg-areas.gh (Grasshopper 1.0.7)

geometry = Geometry([<curve referenced from the Rhino model> x8])

# ----
# Internalized
# Archive
geometry_2 = Geometry([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])

geometry_3 = Geometry([<curve referenced from the Rhino model> x9])

# ----
# Internalized
# Archive
geometry_4 = Geometry(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)

# ----
# Internalized
# Archive
geometry_5 = Geometry([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])

geometry_6 = Geometry(<curve referenced from the Rhino model>)

# ----
# Internalized
# Archive
geometry_7 = Geometry(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)

# ----
# Internalized
# Archive
geometry_8 = Geometry([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])

geometry_9 = Geometry(<curve referenced from the Rhino model>)
geometry_10 = Geometry([<curve referenced from the Rhino model> x2])
join_curves = JoinCurves(Curves=geometry_3, Preserve=False)
join_curves_2 = JoinCurves(Curves=geometry, Preserve=False)
join_curves_3 = JoinCurves(Curves=geometry_10, Preserve=False)
brep = Brep(graft(geometry_6))
brep_2 = Brep(graft(geometry_9))
# breps from joined curves
brep_3 = Brep(join_curves_3)
brep_4 = Brep(join_curves)
brep_5 = Brep(join_curves_2)

# ----
# merge region lists
merge = Merge(Data1=brep_3, Data2=brep_4, Data3=brep_5, Data4=brep, Data5=brep_2)

colour_swatch = ColourSwatch(SwatchColor=RGB(255, 242, 0))

number_slider = Slider(3, range=0..10)
# item-area-tag
area = Area(Geometry=merge)  # -> Area, Centroid
format = Format(Format="{0:0.00 SF}", Culture=127, Data0=area.Area)
text_tag_3d = TextTag3D(Location=area.Centroid, Text=format, Size=number_slider, Colour=colour_swatch, Justification=7)

# ----
# Combined SF
panel = Panel("{0:0.00 SF Total}")
average = Average(Input=area.Centroid)
mass_addition = MassAddition(Input=area.Area)  # -> Result, PartialResults
colour_swatch_2 = ColourSwatch(SwatchColor=RGB(255, 242, 0))
format_2 = Format(Format=panel, Culture=127, Data0=mass_addition.Result)
text_tag_3d_2 = TextTag3D(Location=average, Text=format_2, Size=number_slider, Colour=colour_swatch, Justification=7)

# ----
# Necessary SF -  4627
panel_2 = Panel("{0:0.00 SF Vegetation Needed}")
number = Number("4627")
subtraction = Subtraction(A=number, B=mass_addition.Result)
format_3 = Format(Format=panel_2, Culture=127, Data0=subtraction)
text_tag_3d_3 = TextTag3D(Location=average, Text=format_3, Size=number_slider, Colour=ColourSwatch(SwatchColor=RGB(8, 0, 255)), Justification=1)
