# Grasshopper definition brep_to_simplified_curves.gh (Grasshopper 1.0.7)

geometry = Geometry(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)
brep = Brep(geometry)
deconstruct_brep = DeconstructBrep(Brep=brep)  # -> Faces, Edges, Vertices
simplify_curve = SimplifyCurve(Curve=deconstruct_brep.Edges, Tolerance=Slider(1, range=0..1), AngleTolerance=Slider(10, range=0..10))  # -> Curve, Simplified
curve = Curve(simplify_curve.Curve)
