# Grasshopper definition dotbimexport-ex.gh (Grasshopper 1.0.7)
# plug-ins: dotbimGH, CORE.Toolbox.Grasshopper, eleFront

domain_box = DomainBox(Base=PlaneXY(0, 0, 0), X=Domain(-2, 2), Y=Domain(-0.5, 0.5), Z=Domain(0, 0.25))
create_guids = CreateGuids(Count=1)
create_guid = CreateGuid(Count="1")
mesh = Mesh(domain_box)
triangulate = Triangulate(Mesh=mesh)  # -> Mesh, Count
define_color = DefineColor(Source="object")
create_info = CreateInfo(Keys="2", Values="\"base\"")
create_element = CreateElement(Mesh=triangulate.Mesh, Guid=create_guid, Type="\"box\"", Color=define_color, Info=create_info)  # -> Element, Preview
create_info_2 = CreateInfo(Keys="3", Values="first export")
file_path = FilePath("C:\Users\peter\Downloads\test.bim")
create_file = CreateFile(ElementsSetsOrElements=create_element.Element, Info=create_info_2, Path=file_path)
