# Grasshopper definition topologic_boolean_1.gh (Grasshopper 1.0.7)
# plug-ins: TopologicGH

geometry = Geometry(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)
geometry_2 = Geometry(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)
topology_bygeometry = TopologyByGeometry(Geometry=geometry, Tolerance=0.0001)
topology_bygeometry_2 = TopologyByGeometry(Geometry=geometry_2, Tolerance=0.0001)
topology_union = TopologyUnion(Topology=topology_bygeometry_2, Topology_2=topology_bygeometry, TransferDictionary=False)
topology_merge = TopologyMerge(Topology=topology_bygeometry_2, Topology_2=topology_bygeometry, TransferDictionary=False)
topology_difference = TopologyDifference(Topology=topology_bygeometry_2, Topology_2=topology_bygeometry, TransferDictionary=False)
topology_impose = TopologyImpose(Topology=topology_bygeometry, Tool=topology_bygeometry_2, TransferDictionary=False)
topology_imprint = TopologyImprint(Topology=topology_bygeometry_2, Tool=topology_bygeometry, TransferDictionary=False)
topology_slice = TopologySlice(Topology=topology_bygeometry_2, Tool=topology_bygeometry, TransferDictionary=False)
topology_geometry = TopologyGeometry(Topology=topology_union, Tolerance=0.0001)
topology_geometry_2 = TopologyGeometry(Topology=topology_merge, Tolerance=0.0001)
topology_geometry_3 = TopologyGeometry(Topology=topology_difference, Tolerance=0.0001)
topology_geometry_4 = TopologyGeometry(Topology=topology_impose, Tolerance=0.0001)
topology_geometry_5 = TopologyGeometry(Topology=topology_imprint, Tolerance=0.0001)
topology_geometry_6 = TopologyGeometry(Topology=topology_slice, Tolerance=0.0001)
