# Grasshopper definition topologic_package_basic.gh (Grasshopper 1.0.7)
# plug-ins: TopologicGH, Bifocals

geometry = Geometry([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])
geometry_2 = Geometry(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)
geometry_3 = Geometry(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)
topology_bygeometry = TopologyByGeometry(Geometry=geometry_3, Tolerance=0.0001)
topology_bygeometry_2 = TopologyByGeometry(Geometry=geometry, Tolerance=0.0001)
topology_bygeometry_3 = TopologyByGeometry(Geometry=geometry_2, Tolerance=0.0001)
panel = Panel(topology_bygeometry_3)
cellcomplex_bycells = CellComplexByCells(Cells=topology_bygeometry_2)
topology_typeasstring = TopologyTypeAsString(Topology=topology_bygeometry_3)
cluster_bytopologies = ClusterByTopologies(Topologies=[topology_bygeometry, cellcomplex_bycells])
cell_faces = CellFaces(Cell=topology_bygeometry_3)
topology_geometry = TopologyGeometry(Topology=cellcomplex_bycells, Tolerance=0.0001)
topology_geometry_2 = TopologyGeometry(Topology=cluster_bytopologies, Tolerance=0.0001)
topology_geometry_3 = TopologyGeometry(Topology=cell_faces, Tolerance=0.0001)
cell_byfaces = CellByFaces(Faces=cell_faces, Tolerance=0.001)
list_item = ListItem(List=topology_geometry, Index=Slider(2, range=0..10), Wrap=True)
topology_geometry_4 = TopologyGeometry(Topology=cell_byfaces, Tolerance=0.0001)
panel_2 = Panel(topology_geometry_3)
list_item_2 = ListItem(List=topology_geometry_2, Index=Slider(0, range=0..10), Wrap=True)
panel_3 = Panel(topology_geometry_4)
