# Grasshopper definition line-to-cladding-wip.gh (Grasshopper 1.0.7)

geometry = Geometry([<curve referenced from the Rhino model> x5])
number_slider = Slider(0.125, range=0..1)
curve = Curve(geometry)
join_curves = JoinCurves(Curves=curve, Preserve=False)
explode = Explode(Curve=join_curves, Recursive=True)  # -> Segments, Vertices
length = Length(Curve=explode.Segments)
plane = Plane(explode.Segments)
construct_domain = ConstructDomain(DomainStart=length, DomainEnd=1)
rectangle = Rectangle(Plane=plane, XSize=Domain(-1, 1), YSize=Domain(-2, 2), Radius=0)  # -> Rectangle, Length
