# Grasshopper definition golden_spiral.gh (Grasshopper 1.0.7)
# plug-ins: Python

number_slider = Slider(20, range=0..20)
series = Series(Start=0, Step="pi/2", Count=number_slider)
fibonacci = Fibonacci(SeedA=0, SeedB=1, Number=number_slider)
split_list = SplitList(List=fibonacci, Index=Slider(2, range=0..10))  # -> ListA, ListB
panel = Panel(split_list.ListB)
construct_point = ConstructPoint(XCoordinate=split_list.ListB, YCoordinate=0, ZCoordinate=0)
rotate = Rotate(Geometry=construct_point, Angle=series, Plane=PlaneXY(0, 0, 0))  # -> Geometry, Transform
toggle = Toggle(port=Button())
interpolate = Interpolate(Vertices=rotate.Geometry, Degree=3, Periodic=toggle, KnotStyle=Slider(0, range=0..100))  # -> Curve, Length, Domain
