# Grasshopper definition golden_spiral_node.gh (Grasshopper 1.0.7)
# plug-ins: Python

plane = Plane(PlaneXY(-347.6147701, 117.3194415, 0))
golden_spiral = GoldenSpiral(Plane=plane, Count="10", Scale=Slider(40, range=0..40))  # -> Spiral, Rectangle
