# Grasshopper definition hatch-to-surf.gh (Grasshopper 1.0.7)

geometry = Geometry(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)
brep = Brep(geometry)
# srf-from-hatch
deconstruct_brep = DeconstructBrep(Brep=brep)  # -> Faces, Edges, Vertices
boundary_surfaces = BoundarySurfaces(Edges=deconstruct_brep.Edges)

geometry_2 = Geometry(<surface referenced from the Rhino model>)

# ----
# area-tag
area = Area(Geometry=geometry_2)  # -> Area, Centroid
format = Format(Format="{0:0.00}", Culture=127, Data0=area.Area)
text_tag_3d = TextTag3D(Location=area.Centroid, Text=format, Size=Slider(5, range=0..100), Justification=7)
