# Grasshopper definition import_revit_topo.gh (Grasshopper 1.0.7)
# plug-ins: Rhino.Inside for Autodesk Revit, EleFront, PTComponentLibrary

built_in_categories = BuiltInCategories("autodesk.revit.category.local:topography-1.0.0", LayoutLevel=2, SearchPattern="topo")
phase = Phase(<phase referenced from the Revit model>)
phase_status_filter = PhaseStatusFilter(Phase=phase, Status="New", Inverted=False)
category_filter = CategoryFilter(Categories=built_in_categories, Inverted=False)
logical_and_filter = LogicalAndFilter(FilterA=category_filter, FilterB=phase_status_filter)
query_elements = QueryElements(Filter=logical_and_filter)  # -> Elements, Count
element_geometry = ElementGeometry(Elements=query_elements.Elements)
value_list = ValueList({"Point": 0, "Curve": 1, "Arc": 2, "Circle": 3, "Ellipse": 4, "Line": 5, "Polyline": 6, "Surface": 7, "Brep": 8, "Mesh": 9, "Polysurface": 10, "Block": 11, "Text": 12, "TextDot": 13, "Dimension": 14, "LinearDimension": 15, "AngularDimension": 16, "Hatch": 17, "Leader": 18}, selected="Mesh")
panel = Panel(element_geometry)
filter_by_type = FilterByType(Geometry=element_geometry, ObjectType=value_list)
deconstruct_mesh = DeconstructMesh(Mesh=filter_by_type)  # -> Vertices, Faces, Colours, Normals
deconstruct_face = DeconstructFace(Face=deconstruct_mesh.Faces)  # -> CornerA, CornerB, CornerC, CornerD
list_item = ListItem(Faces=deconstruct_mesh.Vertices, Index=deconstruct_face.CornerC, Wrap=True)
list_item_2 = ListItem(Faces=deconstruct_mesh.Vertices, Index=deconstruct_face.CornerA, Wrap=True)
list_item_3 = ListItem(Faces=deconstruct_mesh.Vertices, Index=deconstruct_face.CornerD, Wrap=True)
list_item_4 = ListItem(Faces=deconstruct_mesh.Vertices, Index=deconstruct_face.CornerB, Wrap=True)
_4point_surface = _4PointSurface(CornerA=list_item_2, CornerB=list_item_4, CornerC=list_item, CornerD=list_item_3)
number_slider = Slider(1, range=0..10)
surface_domain_number = SurfaceDomainNumber(UNumber=number_slider, VNumber=number_slider)
