# Grasshopper definition golden_spiral.gh (Grasshopper 1.0.7)
# plug-ins: GhPython Script

fibonacci = Fibonacci(SeedA=Slider(1, range=0..10), SeedB=Slider(1, range=0..10), Number=10)  # -> flatten(Series)
ghpython_script = GhPythonScript(x=fibonacci)  # -> out, a, b; inputs x: list, y: list
# ---------- ghpython_script: Python ----------
__author__ = "peter"
__version__ = "2023.06.06"

import rhinoscriptsyntax as rs

print(x)

x = [int(i) for i in x]
print(x)
def flip(x):
    return [x[i]*-1 if i % 2 == 0 else x[i] for i in range(len(x))]
    
x_flip = [x[i]*-1 if i % 2 == 0 else x[i] for i in range(len(x))]
y_flip = [x[i]*-1 if i % 2 == 0 else x[i] for i in range(len(x))]
print x_flip
print y_flip

a = x_flip
b = y_flip
# ---------- end ghpython_script ----------
ghpython_script_2 = GhPythonScript(x=fibonacci, y=fibonacci)  # -> out, a, b; inputs x: list, y: list
# ---------- ghpython_script_2: Python ----------
__author__ = "peter"
__version__ = "2023.06.06"

import rhinoscriptsyntax as rs

def alt_and_flip(x):
    x = [int(x[i]) for i in range(len(x))]
#    x = [i for i in x if i % 2 == 0]
    x_flip = [x[i]*-1 if i % 2 == 0 else x[i] for i in range(len(x))]
    return x_flip

a = alt_and_flip(x)
b = alt_and_flip(y)
# ---------- end ghpython_script_2 ----------
ghpython_script_3 = GhPythonScript(x=ghpython_script.a, y=ghpython_script.a)  # -> out, a; inputs x: list, y: list
# ---------- ghpython_script_3: Python ----------
__author__ = "peter"
__version__ = "2023.06.06"

import rhinoscriptsyntax as rs

print(zip(x,y))
a = [item for pair in zip(x,y) for item in pair]
print(a)
# ---------- end ghpython_script_3 ----------
construct_point = ConstructPoint(XCoordinate=ghpython_script_2.a, YCoordinate=0, ZCoordinate=0)
construct_point_2 = ConstructPoint(XCoordinate=0, YCoordinate=ghpython_script_2.b, ZCoordinate=0)
ghpython_script_4 = GhPythonScript()  # -> Out, A
ghpython_script_5 = GhPythonScript()  # -> Out, A
arc_ser = ArcSER(Start=construct_point, End=construct_point_2, Radius=fibonacci)  # -> Arc, Center
