# Grasshopper definition rainwater_flow [Feb-13 '23, 0458].gh (Grasshopper 1.0.7)
# plug-ins: Anemone, Kangaroo2 Components, DendroGH

number_slider = Slider(100, range=0..1000)
surface = Surface(<surface referenced from the Rhino model>)
divide_surface = DivideSurface(Surface=surface, UCount=number_slider, VCount=number_slider)  # -> flatten(Points), Normals, Parameters
negative = Negative(Value=Slider(10, range=0..10))
loop_start = LoopStart(Repeat=Slider(50, range=0..1000), Trigger=Button(), Data=divide_surface.Points)  # -> port, Counter, Data
unit_z = UnitZ(Factor=negative)
move = Move(Geometry=loop_start.Data, Motion=unit_z)  # -> Geometry, Transform
panel = Panel(loop_start.Counter)
surface_closest_point = SurfaceClosestPoint(Point=move.Geometry, Surface=surface)  # -> Point, UVPoint, Distance
running = Running(
    port=loop_start.port,
    Exit=False,
    Data=surface_closest_point.Point,
    TimeOutVal=0,
    pausedState=False,
    state="Constant & Record")
flip_matrix = FlipMatrix(Data=running)
removeduplicatepts = RemoveDuplicatePts(Points=flip_matrix, Tolerance=0.01)
polyline = PolyLine(Vertices=removeduplicatepts, Closed=False)  # -> flatten(Polyline)
clean_tree = CleanTree(RemoveNulls=True, RemoveInvalid=True, RemoveEmpty=False)
data_dam = DataDam(DataDataA=clean_tree, BufferDelay=10000000, BufferMode=0)
create_settings = CreateSettings(VoxelSize=Slider(0.1, range=0..1), Bandwidth=1, Isovalue=0, Adaptivity=0.1)
curve_to_volume = CurveToVolume(Curves=data_dam, CurveRadius=Slider(0.2, range=0..1), Settings=create_settings)
panel_2 = Panel(curve_to_volume)
smooth_volume = SmoothVolume(Volume=curve_to_volume, Width=1, Type=2, Iterations=1)
volume_to_mesh = VolumeToMesh(Volume=smooth_volume, VolumeSettings=create_settings)
panel_3 = Panel(volume_to_mesh)
