# Grasshopper definition rainwater_flow.gh (Grasshopper 1.0.7)
# plug-ins: Anemone, Kangaroo2 Components, DendroGH

number_slider = Slider(5, range=0..1000)
surface = Surface(<surface referenced from the Rhino model>)
divide_surface = DivideSurface(Surface=surface, UCount=number_slider, VCount=number_slider)  # -> flatten(Points), Normals, Parameters
negative = Negative(Value=Slider(20, range=0..100))
loop_start = LoopStart(Repeat=Slider(2, range=0..1000), Trigger=Button(), Data=divide_surface.Points)  # -> port, Counter, Data
unit_z = UnitZ(Factor=negative)
panel = Panel(loop_start.Counter)
move = Move(Geometry=loop_start.Data, Motion=unit_z)  # -> Geometry, Transform
surface_closest_point = SurfaceClosestPoint(Point=move.Geometry, Surface=surface)  # -> Point, UVPoint, Distance
loop_end = LoopEnd(
    port=loop_start.port,
    Exit=False,
    Data=surface_closest_point.Point,
    TimeOutVal=0,
    pausedState=False,
    state="Constant & Record")
flip_matrix = FlipMatrix(Data=loop_end)
removeduplicatepts = RemoveDuplicatePts(Points=flip_matrix, Tolerance=0.01)
polyline = PolyLine(Vertices=removeduplicatepts, Closed=False)  # -> flatten(Polyline)
clean_tree = CleanTree(RemoveNulls=True, RemoveInvalid=True, RemoveEmpty=False, Tree=polyline)
divide_curve = DivideCurve(Count=10, Kinks=False)  # -> Points, Tangents, Parameters
data_dam = DataDam(BufferDelay=10000000, BufferMode=0)
shatter = Shatter(Parameters=divide_curve.Parameters)
create_settings = CreateSettings(VoxelSize=Slider(1, range=0..1), Bandwidth=1, Isovalue=0, Adaptivity=0.1)
end_points = EndPoints(Curve=shatter)  # -> Start, End
curve_to_volume = CurveToVolume(Curves=data_dam, CurveRadius=Slider(1, range=0..1), Settings=create_settings)
point = Point(end_points.Start)
point_2 = Point(end_points.End)
domain = Domain(shatter)
panel_2 = Panel(curve_to_volume)
smooth_volume = SmoothVolume(Volume=curve_to_volume, Width=1, Type=2, Iterations=1)
deconstruct_domain = DeconstructDomain(Domain=domain)  # -> Start, End
unit_z_2 = UnitZ(Factor=1)
gradient = Gradient(
    LowerLimit=deconstruct_domain.Start,
    UpperLimit=deconstruct_domain.End,
    stops=[0: RGB(234, 38, 0), 0.25: RGB(234, 126, 0), 0.5: RGB(254, 244, 84), 0.75: RGB(173, 203, 249), 1: RGB(75, 107, 169)])
xy_plane = XYPlane(Origin=point_2)
line_sdl = LineSDL(Start=point, Direction=unit_z_2, Length=Slider(-10, range=-20..1))  # disabled
volume_to_mesh = VolumeToMesh(Volume=smooth_volume, VolumeSettings=create_settings)
panel_3 = Panel(volume_to_mesh)
custom_preview = CustomPreview(Material=gradient)
curve_plane = CurvePlane(Curve=line_sdl, Plane=xy_plane)  # -> Points, ParamsC, ParamsP
line = Line(StartPoint=point, EndPoint=curve_plane.Points)  # -> flatten(Line)
line_2 = Line(StartPoint=curve_plane.Points, EndPoint=point_2)  # -> flatten(Line)
