# Grasshopper definition rainwater_flow_color.gh (Grasshopper 1.0.7)
# plug-ins: Anemone, LadybugGrasshopper

surface = Surface(<surface referenced from the Rhino model>)
deconstruct_brep = DeconstructBrep(Brep=surface)  # -> Faces, Edges, Vertices
number_slider = Slider(5, range=0..100)
surface_2 = Surface(<surface referenced from the Rhino model>)
curve = Curve(deconstruct_brep.Edges)
divide_domain² = DivideDomain²(Domain=surface_2, UCount=number_slider, VCount=number_slider)
custom_preview = CustomPreview(Geometry=curve, Material=ColourSwatch(SwatchColor=RGB(0, 0, 0)))
custom_preview_2 = CustomPreview(Geometry=surface, Material=ColourSwatch(SwatchColor=RGBA(176, 176, 176, 21)))
isotrim = Isotrim(Surface=surface_2, Domain=divide_domain²)
area = Area(Geometry=isotrim)  # -> Area, Centroid
unit_z = UnitZ(Factor=1)
point = Point(area.Centroid)
line_sdl = LineSDL(Start=point, Direction=unit_z, Length="-70")
brep_curve = BrepCurve(Brep=surface, Curve=line_sdl)  # -> Curves, flatten(Points)
point_2 = Point(brep_curve.Points)
lb_falsestarttoggle = LBFalseStartToggle(False)
number_slider_2 = Slider(150, range=0..300)
unit_z_2 = UnitZ(Factor=Slider(-10, range=-100..10))
loop_start = LoopStart(Repeat=number_slider_2, Trigger=lb_falsestarttoggle, Data=point_2)  # -> port, Counter, Data; disabled
fast_loop_start = FastLoopStart(Iterations=number_slider_2, Data=point_2)  # -> port, Counter, Data
move = Move(Geometry=fast_loop_start.Data, Motion=unit_z_2)  # -> Geometry, Transform
surface_closest_point = SurfaceClosestPoint(Point=move.Geometry, Surface=surface)  # -> Point, UVPoint, Distance
fast_loop_end = FastLoopEnd(port=fast_loop_start.port, Exit=False, Data=surface_closest_point.Point, RecordData=True, TimeOutVal=0)
loop_end = LoopEnd(port=loop_start.port, Exit=False, TimeOutVal=0, pausedState=False, state="Constant & Record")  # disabled
graft_tree = GraftTree(Tree=point_2, IncludeEmptyLists=True, IncludeNullItems=True)
point_3 = Point(fast_loop_end)
flip_matrix = FlipMatrix(Data=point_3)
insert_items = InsertItems(List=flip_matrix, Item=graft_tree, Indices=Slider(0, range=0..100), Wrap=True)
sub_list = SubList(List=insert_items, Domain="0 to 1", Wrap=True)  # -> List, Index
polyline = PolyLine(Vertices=insert_items, Closed=False)
polyline_2 = PolyLine(Vertices=sub_list.List, Closed=False)
plane_normal = PlaneNormal(Origin=graft_tree, ZAxis=polyline_2)
divide_curve = DivideCurve(Curve=polyline, Count=number_slider_2, Kinks=False)  # -> Points, Tangents, Parameters
shatter = Shatter(Curve=polyline, Parameters=divide_curve.Parameters)
circle = Circle(Plane=plane_normal, Radius=Slider(0.59, range=0..1))
end_points = EndPoints(Curve=shatter)  # -> Start, End
custom_preview_3 = CustomPreview(Geometry=circle, Material=ColourSwatch(SwatchColor=RGB(0, 0, 0)))
point_4 = Point(end_points.Start)
point_5 = Point(end_points.End)
unit_z_3 = UnitZ(Factor=1)
xy_plane = XYPlane(Origin=point_5)
line_sdl_2 = LineSDL(Start=point_4, Direction=unit_z_3, Length=Slider(-10, range=-20..1))
curve_plane = CurvePlane(Curve=line_sdl_2, Plane=xy_plane)  # -> Points, ParamsC, ParamsP
line = Line(StartPoint=flatten(point_4), EndPoint=flatten(curve_plane.Points))
boolean_toggle = BooleanToggle(True)
line_2 = Line(StartPoint=flatten(curve_plane.Points), EndPoint=flatten(point_5))
length = Length(Curve=line_2)
length_2 = Length(Curve=line)
clean_tree = CleanTree(RemoveNulls=True, RemoveInvalid=True, RemoveEmpty=False, Tree=length_2)
division = Division(A=clean_tree, B=length)
clean_tree_2 = CleanTree(RemoveNulls=True, RemoveInvalid=True, RemoveEmpty=False, Tree=division)
clean_tree_3 = CleanTree(RemoveNulls=True, RemoveInvalid=True, RemoveEmpty=False, Tree=division)
bounds = Bounds(Numbers=clean_tree_2)
deconstruct_domain = DeconstructDomain(Domain=bounds)  # -> Start, End
gradient = Gradient(
    LowerLimit=deconstruct_domain.Start,
    UpperLimit=deconstruct_domain.End,
    Parameter=clean_tree_3,
    stops=[0.0417: RGB(0, 60, 255), 0.188: RGB(64, 255, 0)])
custom_preview_4 = CustomPreview(Geometry=shatter, Material=gradient)
