# Grasshopper definition revit_to_rhino_by_category.gh (Grasshopper 1.0.7)
# plug-ins: Rhino.Inside for Autodesk Revit

active_graphical_view = ActiveGraphicalView()
selectable_in_view_filter = SelectableInViewFilter(View=active_graphical_view, Inverted=False)
query_elements = QueryElements(Filter=selectable_in_view_filter, Limit=100)  # -> Elements, Count
element_type = ElementType(Element=query_elements.Elements)  # -> Element, Type
element_category = ElementCategory(Element=element_type.Element)  # -> Element, Category
category_rule = CategoryRule(Categories=element_category.Category)
add_parameter_filter = AddParameterFilter(TrackingMode=2)
