# Grasshopper definition rhino_to_revit_by_layer.gh (Grasshopper 1.0.7)
# plug-ins: EleFront, Rhino.Inside for Autodesk Revit

reference_by_layer = ReferenceByLayer(LayerName="Rhino_To_Revit")
category = Category(<category referenced from the Revit model>)
add_geometry_directshape = AddGeometryDirectShape(Geometry=reference_by_layer, TrackingMode=2)
