# Grasshopper definition linear_interpolation_by_three_points.gh (Grasshopper 1.0.7)

number_slider = Slider(20, range=0..100)
number_slider_2 = Slider(15, range=0..100)
construct_point = ConstructPoint(XCoordinate=0, YCoordinate=0, ZCoordinate=0)
unit_y = UnitY(Factor=number_slider_2)
unit_x = UnitX(Factor=number_slider)
move = Move(Geometry=construct_point, Motion=unit_y)  # -> Geometry, Transform
move_2 = Move(Geometry=construct_point, Motion=unit_x)  # -> Geometry, Transform

random = Random(Range=Slider(10, range=0..10), Number="3", Seed=Slider(56, range=0..100))  # -> flatten(Random)

merge = Merge(Data1=move_2.Geometry, Data2=move.Geometry, Data3=construct_point)
unit_z = UnitZ(Factor=random)
move_3 = Move(Geometry=merge, Motion=unit_z)  # -> Geometry, Transform
split_tree = SplitTree(Data=move_3.Geometry, Masks=flatten("{0;*}"))  # -> Positive, Negative
explode_tree = ExplodeTree(Data=graft(move_3.Geometry))  # -> Branch0, Branch1, Branch2
_4point_surface = _4PointSurface(CornerA=explode_tree.Branch0, CornerB=explode_tree.Branch1, CornerC=explode_tree.Branch2)
area = Area(Geometry=_4point_surface)  # -> Area, Centroid
evaluate_surface = EvaluateSurface(Surface=_4point_surface, Point=area.Centroid)  # -> Point, Normal, UDirection, VDirection, Frame
construct_point_2 = ConstructPoint(XCoordinate=number_slider_2, YCoordinate=number_slider, ZCoordinate=0)
plane = Plane(evaluate_surface.Frame)
unit_z_2 = UnitZ(Factor=1)
project_point = ProjectPoint(Point=construct_point_2, Direction=unit_z_2, Geometry=plane)  # -> Point, Index
merge_2 = Merge(
    Data1=flatten(project_point.Point),
    Data2=flatten(explode_tree.Branch0),
    Data3=flatten(explode_tree.Branch1),
    Data4=flatten(explode_tree.Branch2))
sphere = Sphere(Base=project_point.Point, Radius=1)
text_tag_3d = TextTag3D(Location=merge_2, Text=merge_2, Size=1, Justification=7)
