# Grasshopper definition parametric-extrusion-arr-from-crvs.gh (Grasshopper 1.0.7)

# ----
# origin
point = Point(<point referenced from the Rhino model>)

# ----
# Set Count
number_slider = Slider(21, range=0..100)

# ----
# Extrusion Depth
number_slider_2 = Slider(1.5, range=0..10)

# ----
# Extrusion Width
number_slider_3 = Slider(0.75, range=0..1)

# ----
# x crv
curve = Curve(<curve referenced from the Rhino model>)

# ----
# y crv
curve_2 = Curve(<curve referenced from the Rhino model>)

# ----
# Set Path Curve
curve_3 = Curve(<curve referenced from the Rhino model>)

# ----
# Set Multiple Curves for Profile
curve_4 = Curve([<curve referenced from the Rhino model> x3])

join_curves = JoinCurves(Curves=curve_4, Preserve=False)
xz_plane = XZPlane(Origin=Point(0, 0, 0))
offset_curve = OffsetCurve(Curve=join_curves, Distance=number_slider_2, Corners=1)
construct_plane = ConstructPlane(Origin=point, XAxis=curve, YAxis=curve_2)
merge = Merge(Data1=flatten(join_curves), Data2=flatten(offset_curve))
deconstruct_plane = DeconstructPlane(Plane=construct_plane)  # -> Origin, XAxis, YAxis, ZAxis
loft = Loft(Curves=flatten(merge), Options={Adjust=False, Closed=False, LoftEnds=0, LoftSimp=0, LoftType=0, Rebuild=10, Refit=0.01})
amplitude = Amplitude(Vector=deconstruct_plane.ZAxis, Amplitude=number_slider_3)
multiplication = Multiplication()
extrude = Extrude(Base=loft, Direction=amplitude)
curve_array = CurveArray(Geometry=extrude, Curve=curve_3, Count=number_slider)  # -> Geometry, Transform
list_item = ListItem(List=curve_array.Geometry, Index="1", Wrap=True)
list_item_2 = ListItem(List=curve_array.Geometry, Index="0", Wrap=True)
area = Area(Geometry=list_item)  # -> Area, Centroid
area_2 = Area(Geometry=list_item_2)  # -> Area, Centroid
distance = Distance(PointA=area.Centroid, PointB=area_2.Centroid)

# ----
# Spacing(Report Only)
panel = Panel(distance)
