# Grasshopper definition pyramid.gh (Grasshopper 1.0.7)

curve = Curve([<curve referenced from the Rhino model> x4])
Z = UnitZ(Factor=1)
number_slider = Slider(1200, range=0..1200, expression="x*-1")
projecttomesh = CSharpScript(dir=Z)  # -> out, flatten(A); inputs curve: Curve, mesh: Mesh, dir: Vector3d
# ---------- projecttomesh: C# usings ----------
using System.IO;
using System.Linq;
using System.Data;
using System.Drawing;
using System.Reflection;
using System.Windows.Forms;
using System.Xml;
using System.Xml.Linq;
using System.Runtime.InteropServices;

using Rhino.DocObjects;
using Rhino.Collections;
using GH_IO;
using GH_IO.Serialization;
# ---------- projecttomesh: C# ----------
    if (null != curve && null != mesh && dir.IsValid)
    {
      var tol = RhinoDoc.ActiveDoc.ModelAbsoluteTolerance;
      A = Curve.ProjectToMesh(curve, mesh, dir, tol);
    }
# ---------- end projecttomesh ----------
join_curves = JoinCurves(Curves=curve, Preserve=False)
pulltomesh = CSharpScript()  # -> out, A; inputs curve: Curve, mesh: Mesh
# ---------- pulltomesh: C# ----------
    if (null != curve && null != mesh)
    {
      var tol = RhinoDoc.ActiveDoc.ModelAbsoluteTolerance;
      A = curve.PullToMesh(mesh, tol);
    }
# ---------- end pulltomesh ----------
number_slider_2 = Slider(1000, range=0..10000)
geometry = Geometry(<brep referenced from the Rhino model>)
panel = Panel(projecttomesh.A)
panel_2 = Panel(pulltomesh.A)
project = Project(Curve=join_curves, Brep=geometry, Direction=Vector(0, 0, 1))  # -> flatten(Curve)
xy_plane = XYPlane(Origin=Point(0, 0, 0))
explode = Explode(Curve=project, Recursive=True)  # -> flatten(Segments), Vertices
offset_curve = OffsetCurve(Curve=explode.Segments, Distance=number_slider_2, Plane=xy_plane, Corners=1)  # -> flatten(Curve)
panel_3 = Panel(project)
unit_z = UnitZ(Factor=number_slider_2)
move = Move(Geometry=offset_curve, Motion=unit_z)  # -> Geometry, Transform
merge = Merge(Data1=graft(move.Geometry), Data2=graft(explode.Segments))
loft = Loft(Curves=merge, Options={Adjust=False, Closed=False, LoftEnds=0, LoftSimp=0, LoftType=0, Rebuild=10, Refit=0.01})
