# Grasshopper definition rh_curve_to_rvt_dtl_line.gh (Grasshopper 1.0.7)
# plug-ins: Rhino.Inside for Autodesk Revit

geometry = Geometry([<curve referenced from the Rhino model> x85])
panel = Panel(geometry)
explode = Explode(Curve=geometry, Recursive=True)  # -> Segments, Vertices
active_graphical_view = ActiveGraphicalView()
add_detail_line = AddDetailLine(View=active_graphical_view, Curve=explode.Segments, TrackingMode=2)
