# Grasshopper definition regions_and_detail_to_rhino.gh (Grasshopper 1.0.7)
# plug-ins: Rhino.Inside for Autodesk Revit, Python, EleFront, Pufferfish, eleFront

query_categories = QueryCategories(Type=1, Name="Detail Items", IsSubcategory=False)  # -> flatten(Categories)
active_graphical_view = ActiveGraphicalView()
category_filter = CategoryFilter(Categories=query_categories, Inverted=False)
visible_in_view_filter = VisibleInViewFilter(View=active_graphical_view, Inverted=False)
intersection_filter = IntersectionFilter(Filters=[visible_in_view_filter, category_filter])
query_elements = QueryElements(Filter=intersection_filter, Limit=100)  # -> Elements, Count
element_geometry = ElementGeometry(Elements=query_elements.Elements)
surface = Surface(element_geometry)
list_length = ListLength(List=surface)
panel = Panel(surface)
list_indices = ListIndices(List=flatten(list_length))
area = Area(Geometry=surface)  # -> Area, Centroid
get_rhino_attributes = GetRhinoAttributes(Geometry=surface)  # -> Name, Layer, Color
random_colors = RandomColors(Count=list_length)
define_layer = DefineLayer(Name=list_indices, Color=flatten(random_colors))  # -> flatten(Layer)
shader = Shader(random_colors)
text_tag = TextTag(Location=area.Centroid, Text=area.Area)
elefront_attributes = EleFrontAttributes(Layer=define_layer)  # -> Attributes, Keys, Values, Name, Layer, ColourSource, DisplayColour, MaterialSource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
text_tag_3d = TextTag3D(Location=area.Centroid, Text=area.Area, Size=1, Justification=7)
custom_preview = CustomPreview(Geometry=surface, Material=shader)
bake_objects = BakeObjects(Geometry=flatten(surface), Attributes=elefront_attributes.Attributes, Bake=False, createGroups=False)  # -> Message, Guids
modify_rhino_object_attributes = ModifyRhinoObjectAttributes(ReferencedObject=surface, Activate=False)
