# Grasshopper definition wip_detail_lines_to_rhino.gh (Grasshopper 1.0.7)
# plug-ins: Rhino.Inside for Autodesk Revit

active_graphical_view = ActiveGraphicalView()
# detail items
category = Category(<category referenced from the Revit model>)
query_view_elements = QueryViewElements(View=active_graphical_view)
curve_element = CurveElement(query_view_elements)
clean_tree = CleanTree(RemoveNulls=True, RemoveInvalid=True, RemoveEmpty=False, Tree=curve_element)
