# Grasshopper definition geom_to_topo.gh (Grasshopper 1.0.7)
# plug-ins: Rhino.Inside for Autodesk Revit, GhPython Script

geometry = Geometry(<brep referenced from the Rhino model>)
bounding_box = BoundingBox(Content=geometry, Plane=PlaneXY(0, 0, 0))  # -> Box, Box_2
divide_domain² = DivideDomain²(Domain=bounding_box.Box, UCount=10, VCount=10)
populate_2d = Populate2D(Region=bounding_box.Box, Count=Slider(200, range=0..1000), Seed=1)
project_points = ProjectPoints(Geometries=geometry, Points=populate_2d)  # -> Points, Index
add_topography_points = AddTopographyPoints(Points=project_points.Points, TrackingMode=2)
