# Grasshopper definition selected_geom_to_revit_ds.gh (Grasshopper 1.0.7)
# plug-ins: Rhino.Inside for Autodesk Revit

built_in_categories = BuiltInCategories(flatten("autodesk.revit.category.family:genericModel-1.0.0"), SearchPattern="generic")
# Right Click this node and
# click either `set one geometry`
# or `set multiple geometries` based
# on how many items you want to
# send to revit
geometry = Geometry(<brep referenced from the Rhino model>)
query_materials = QueryMaterials()
list_item = ListItem(List=query_materials, Index="0", Wrap=True)
add_geometry_directshape = AddGeometryDirectShape(Category=built_in_categories, Geometry=geometry, Material=list_item, TrackingMode=2)
