# Grasshopper definition rir_pyramid.gh (Grasshopper 1.0.7)
# plug-ins: GhPython Script

# ----
# Select Toposurface as Mesh
mesh = Mesh(<mesh referenced from the Rhino model>)

# ----
# Select Prop Lines as Curves
curve = Curve([<curve referenced from the Rhino model> x7])

# ----
# Divide Curve to Points;
# Project Points to Mesh;
divide_curve = DivideCurve(Curve=curve, Count=Slider(25, range=0..100), Kinks=False)  # -> Points, Tangents, Parameters
project_points = ProjectPoints(Geometries=mesh, Points=divide_curve.Points)  # -> Points, Index

# ----
# Rebuild Line Along Mesh;
interpolate = Interpolate(Vertices=project_points.Points, Degree=3, Periodic=False, KnotStyle=1)  # -> Curve, Length, Domain

# ----
# Right Triangle Offset;
# A**2 == B**2; 45 degrees
# Offset B in Z to match A
number_slider = Slider(45, range=0..100)
xy_plane = XYPlane(Origin=Point(0, 0, 0))
offset_curve = OffsetCurve(Curve=interpolate.Curve, Distance=number_slider, Plane=xy_plane, Corners=1)
unit_z = UnitZ(Factor=number_slider)
move = Move(Geometry=offset_curve, Motion=unit_z)  # -> Geometry, Transform

# ----
# Remove Tree Level;
# Loft Each;
trim_tree = TrimTree(Tree=move.Geometry, Depth=1)
loft = Loft(
    Curves=[trim_tree, interpolate.Curve],
    Options={Adjust=False, Closed=False, LoftEnds=0, LoftSimp=0, LoftType=0, Rebuild=10, Refit=0.01})
