# Grasshopper definition stone_pad_even_spacing_IP.gh (Grasshopper 1.0.7)

number_slider = Slider(1, range=0..10)  # disabled
number_slider_2 = Slider(1, range=0..10)  # disabled
geometry = Geometry(<curve referenced from the Rhino model>)
geometry_2 = Geometry(<curve referenced from the Rhino model>)  # disabled
explode = Explode(Curve=geometry, Recursive=True)  # -> Segments, Vertices
plane = Plane(geometry_2)  # disabled
rectangle = Rectangle(geometry_2)  # disabled
divide_domain² = DivideDomain²(Domain=geometry_2, UCount=number_slider, VCount=number_slider_2)  # disabled
join_curves = JoinCurves(Curves=explode.Segments, Preserve=False)
deconstuct_rectangle = DeconstuctRectangle()  # -> BasePlane, XInterval, YInterval; disabled
number_slider_3 = Slider(24, range=0..100)  # disabled
explode_2 = Explode(Curve=rectangle, Recursive=True)  # -> Segments, Vertices; disabled
deconstruct_domain² = DeconstructDomain²(Domain=rectangle)  # -> UMin, UMax, VMin, VMax; disabled
square = Square(Plane=plane, Size=rectangle, ExtentX=5, ExtentY=5)  # -> Cells, Points; disabled
dispatch = Dispatch(List=explode_2.Segments, DispatchPattern=[True, False])  # -> ListA, ListB; disabled
bounding_box = BoundingBox(Content=join_curves, Plane=PlaneXY(0, 0, 0))  # -> Box, Box_2
division = Division(B=number_slider_3)  # disabled
series = Series(Start=0, Step=1, Count=10)  # disabled
length = Length(Curve=dispatch.ListA)  # disabled
deconstruct_brep = DeconstructBrep(Brep=bounding_box.Box)  # -> Faces, Edges, Vertices
surface_closest_point = SurfaceClosestPoint(Point=explode.Vertices, Surface=deconstruct_brep.Faces)  # -> Point, UVPoint, Distance
rectangle_2pt = Rectangle2Pt(Plane=PlaneXY(0, 0, 0), PointA=surface_closest_point.Point, PointB=explode.Vertices, Radius=0)  # -> Rectangle, Length
rectangle_2 = Rectangle(join_curves)
deconstuct_rectangle_2 = DeconstuctRectangle(Rectangle=rectangle_2)  # -> BasePlane, XInterval, YInterval
number_slider_4 = Slider(24, range=0..100)
remap_numbers = RemapNumbers(Value=deconstuct_rectangle_2.YInterval, Source=Domain(0, 1), Target=Domain(0, 1))  # -> Mapped, Clipped
remap_numbers_2 = RemapNumbers(Value=deconstuct_rectangle_2.XInterval, Source=Domain(0, 1), Target=Domain(0, 1))  # -> Mapped, Clipped
division_2 = Division(A=remap_numbers_2.Mapped, B=number_slider_4)
division_3 = Division(A=remap_numbers.Mapped, B=number_slider_4)
round = Round(Number=division_3)  # -> Nearest, Floor, Ceiling
round_2 = Round(Number=division_2)  # -> Nearest, Floor, Ceiling
multiplication = Multiplication(A=round_2.Floor, NumberSlider=number_slider_4)
multiplication_2 = Multiplication(A=round.Floor, B=number_slider_4)
subtraction = Subtraction(A=remap_numbers.Mapped, B=multiplication_2)
subtraction_2 = Subtraction(A=remap_numbers_2.Mapped, B=multiplication)
number_slider_5 = Slider(1, range=0..1)
division_4 = Division(A=subtraction_2, B=round_2.Floor)
division_5 = Division(A=subtraction, B=round.Floor)
addition = Addition(A=division_4, B=number_slider_5)
addition_2 = Addition(A=division_5, B=number_slider_5)
