# Grasshopper definition unnamed.gh (Grasshopper 1.0.7)
# plug-ins: Rhino.Inside for Autodesk Revit

query_views = QueryViews(ViewName="To_Rhino", IsDependent=False, IsTemplate=False)
selectable_in_view_filter = SelectableInViewFilter(View=query_views, Inverted=False)
query_elements = QueryElements(Filter=selectable_in_view_filter)  # -> Elements, Count
element_geometry = ElementGeometry(Elements=query_elements.Elements)  # -> Geometry, Categories
category_identity = CategoryIdentity(Category=element_geometry.Categories)  # -> Type, Name, IsSubcategory
ghpython_script = GhPythonScript(G=element_geometry.Geometry, L=category_identity.Name, B=Button())  # -> out, a
# ---------- ghpython_script: Python ----------
"""Provides a scripting component.
    Inputs:
        G: Geometry to bake
        L: Layer name for bake
        B: Bake Activate
    Output:
        a: The a output variable"""
 
__author__ = "ScottD"
__version__ = "2019.08.10"
 
import rhinoscriptsyntax as rs
import scriptcontext
import Rhino
 
 
if B:
 
    print(type(G)) #debug message to Python output
 
    #we obtain the reference in the Rhino doc
    doc_object = scriptcontext.doc.Objects.Find(G)
    print(type(doc_object))
 
    attributes = doc_object.Attributes
    print('the type of attributes is: ' + str(type(attributes)))     #debug message to Python output
 
    geometry = doc_object.Geometry
    print('the type of geometry is: ' + str(type(doc_object)))     #debug message to Python output
 
    #we change the scriptcontext
    scriptcontext.doc = Rhino.RhinoDoc.ActiveDoc
 
    #we add both the geometry and the attributes to the Rhino doc
    rhino_brep = scriptcontext.doc.Objects.Add(geometry, attributes)
    print('the Rhino doc ID is: ' + str(rhino_brep))     #debug message to Python output
 
    #we can for example change the layer in Rhino...
    if not rs.IsLayer(L):
        rs.AddLayer(L)
    rs.ObjectLayer(rhino_brep, L)
 
    #we put back the original Grasshopper document as default
    scriptcontext.doc = ghdoc
    a = G
# ---------- end ghpython_script ----------
