# Grasshopper definition water flow.gh (Grasshopper 1.0.7)
# plug-ins: Anemone, Kangaroo2 Components, LadybugGrasshopper

number_slider = Slider(100, range=0..100)
surface = Surface(<surface referenced from the Rhino model>)
negative = Negative(Value=Slider(10, range=0..100))
lb_falsestarttoggle = LBFalseStartToggle(False)
divide_surface = DivideSurface(Surface=surface, UCount=number_slider, VCount=number_slider)  # -> flatten(Points), Normals, Parameters
unit_z = UnitZ(Factor=negative)
unit_x = UnitX(Factor=Slider(3, range=0..10))
loop_start = LoopStart(Repeat=Slider(50, range=0..1000), Trigger=lb_falsestarttoggle, Data=divide_surface.Points)  # -> port, Counter, Data
merge = Merge(Data1=unit_z, Data2=unit_x)
move = Move(Geometry=loop_start.Data, Motion=unit_z)  # -> Geometry, Transform
surface_closest_point = SurfaceClosestPoint(Point=move.Geometry, Surface=surface)  # -> Point, UVPoint, Distance
running = Running(
    port=loop_start.port,
    Exit=False,
    Data=surface_closest_point.Point,
    TimeOutVal=0,
    pausedState=False,
    state="Constant & Record")
browse_history = BrowseHistory(Iteration=0, Data_0=loop_start.Data)
flip_matrix = FlipMatrix(Data=running)
removeduplicatepts = RemoveDuplicatePts(Points=flip_matrix, Tolerance=0.01)
polyline = PolyLine(Vertices=removeduplicatepts, Closed=False)
