# Grasshopper definition wip-nurbs-areas.gh (Grasshopper 1.0.7)

# ----
# Internalized
# Archive
geometry = Geometry([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])

geometry_2 = Geometry([<curve referenced from the Rhino model> x8])
geometry_3 = Geometry([<curve referenced from the Rhino model> x9])

# ----
# Internalized
# Archive
geometry_4 = Geometry([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])

# ----
# Internalized
# Archive
geometry_5 = Geometry([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])

geometry_6 = Geometry([<curve referenced from the Rhino model> x2])
join_curves = JoinCurves(Curves=geometry_3, Preserve=False)
join_curves_2 = JoinCurves(Curves=geometry_2, Preserve=False)
join_curves_3 = JoinCurves(Curves=geometry_6, Preserve=False)
brep = Brep(join_curves_2)
brep_2 = Brep(join_curves_3)
brep_3 = Brep(join_curves)
merge = Merge(Data1=brep_2, Data2=brep_3, Data3=brep)
geometry_7 = Geometry(<surface referenced from the Rhino model>)

# ----
# area-tag
area = Area(Geometry=geometry_7)  # -> Area, Centroid
format = Format(Format="{0:0.00}", Culture=127, Data0=area.Area)
text_tag_3d = TextTag3D(Location=area.Centroid, Text=format, Size=Slider(5, range=0..100), Justification=7)
