# Grasshopper definition z_cascading_pts.gh (Grasshopper 1.0.7)
# plug-ins: Anemone, Rhino.Inside for Autodesk Revit

# ---- group: Golden Ratio Step
loop_start = LoopStart(Repeat="4", Trigger=Button(), Data=Slider(0.3, range=0..1))  # -> port, Counter, Data
golden_ratio = GoldenRatio(Factor=1)
panel = Panel(loop_start.Counter)
multiplication = Multiplication(A=loop_start.Data, B=golden_ratio)
loop_end = LoopEnd(port=loop_start.port, Exit=False, Data=multiplication, TimeOutVal=0, pausedState=False, state="Constant & Record")  # -> flatten(Data)
panel_2 = Panel(loop_end)
unit_z = UnitZ(Factor=loop_end)

# ----
geometry = Geometry(<curve referenced from the Rhino model>)

# ---- group: Linear Step
series = Series(Start=Slider(0, range=0..100), Step=Slider(6, range=0..10), Count=Slider(5, range=0..10))
unit_z_2 = UnitZ(Factor=series)

# ----
divide_curve = DivideCurve(Curve=geometry, Count="4", Kinks=False)  # -> Points, Tangents, Parameters
deconstruct = Deconstruct(Point=divide_curve.Points)  # -> XComponent, YComponent, ZComponent
number_slider = Slider(4, range=0..10)
range = Range(Domain=deconstruct.ZComponent, Steps=Slider(1, range=0..10))
range_2 = Range(Domain=number_slider, Steps=number_slider)
list_item = ListItem(List=range, Index=0, Wrap=True)
graph_mapper = GraphMapper(range_2, x0=0, x1=1, y0=0, y1=1, container_name="Sine", Equation_px=[0, 1], Equation_py=[0, 1])
panel_3 = Panel(graph_mapper)
unit_z_3 = UnitZ(Factor=graph_mapper)

move = Move(Geometry=divide_curve.Points, Motion=unit_z_2)  # -> Geometry, Transform
interpolate = Interpolate(Vertices=move.Geometry, Degree=3, Periodic=False, KnotStyle=1)  # -> Curve, Length, Domain

move_2 = Move(Geometry=divide_curve.Points, Motion=unit_z)  # -> Geometry, Transform
interpolate_2 = Interpolate(Vertices=move_2.Geometry, Degree=3, Periodic=False, KnotStyle=1)  # -> Curve, Length, Domain

# ---- group: rvt_move_roofs
graphical_element = GraphicalElement([<roof referenced from the Revit model> x5])
element_parameter = ElementParameter(Element=graphical_element, Parameter="Base Offset From Level", Value=unit_z_2)  # -> Element, Value

# ---- group: Quadratic Step
loop_start_2 = LoopStart(Repeat="4", Trigger=Button(), Data="1.03")  # -> port, Counter, Data
panel_4 = Panel(loop_start_2.Counter)

# ----
square = Square(Value=loop_start_2.Data)

# ---- group: Quadratic Step (continued)
loop_end_2 = LoopEnd(port=loop_start_2.port, Exit=False, Data=square, TimeOutVal=0, pausedState=False, state="Constant & Record")  # -> flatten(Data)
panel_5 = Panel(loop_end_2)
unit_z_4 = UnitZ(Factor=loop_end_2)

# ----
move_3 = Move(Geometry=divide_curve.Points, Motion=unit_z_4)  # -> Geometry, Transform
interpolate_3 = Interpolate(Vertices=move_3.Geometry, Degree=3, Periodic=False, KnotStyle=1)  # -> Curve, Length, Domain

# ---- group: Rectangles on Points
number_slider_2 = Slider(2, range=0..10)
rectangle = Rectangle(Plane=PlaneXY(0, 0, 0), XSize=number_slider_2, YSize=number_slider_2, Radius=0)  # -> Rectangle, Length
area = Area(Geometry=rectangle.Rectangle)  # -> Area, Centroid
vector_2pt = Vector2Pt(PointA=area.Centroid, PointB=move_3.Geometry, Unitize=False)  # -> Vector, Length; disabled
move_4 = Move(Geometry=rectangle.Rectangle, Motion=vector_2pt.Vector)  # -> Geometry, Transform; disabled
end_points = EndPoints(Curve=move_4.Geometry)  # -> Start, End; disabled
vector_display = VectorDisplay(Anchor=area.Centroid, Vector=vector_2pt.Vector)  # disabled
